# Grasshopper definition CT_NEW_UI_Example.gh (Grasshopper 1.0.7)

geo = Geometry(<curve referenced from the Rhino model>)
geo_2 = Geometry(<curve referenced from the Rhino model>)
geo_3 = Geometry([<curve referenced from the Rhino model> x8])
geo_4 = Geometry(<curve referenced from the Rhino model>)
geo_5 = Geometry([<curve referenced from the Rhino model> x3])
geo_6 = Geometry(<curve referenced from the Rhino model>)
number_slider = Slider(0.4, range=0..1)
geo_7 = Geometry([<curve referenced from the Rhino model> x8])
ct_beam = CT_Beam(Centerline=geo_4, ZVector=Vector(0, 0, 1), Width=0.2, Height=0.2, Category="top")  # -> Beam, Blank; inputs Centerline: list of Curve, ZVector: list of Vector3d, Width: list, Height: list, Category: list
#   port Centerline: Referenced curve or line, Guid of curve or line in the active Rhino document.
#   port ZVector: Vector defining the orientation of the cross-section (corresponds to the height dimension). If None, a default will be taken.
#   port Width: Width of the cross-section (usually the smaller dimension).
#   port Height: Height of the cross-section (usually the larger dimension).
#   port Category: Category of a beam.
#   port Beam: Beam object(s).
#   port Blank: Shape of the beam's blank.
# ---------- ct_beam: Python ----------
"""Creates a Beam from a LineCurve."""
import Rhino.Geometry as rg
from compas_rhino.conversions import line_to_compas
from compas_rhino.conversions import vector_to_compas
from ghpythonlib.componentbase import executingcomponent as component
from Grasshopper.Kernel.GH_RuntimeMessageLevel import Error
from Grasshopper.Kernel.GH_RuntimeMessageLevel import Warning

from compas.scene import Scene
from compas_timber.parts.beam import Beam as ctBeam


class Beam_fromCurve(component):
    def RunScript(self, Centerline, ZVector, Width, Height, Category):
        # minimum inputs required
        if not Centerline:
            self.AddRuntimeMessage(Warning, "Input parameter 'Centerline' failed to collect data")
        if not Width:
            self.AddRuntimeMessage(Warning, "Input parameter 'Width' failed to collect data")
        if not Height:
            self.AddRuntimeMessage(Warning, "Input parameter 'Height' failed to collect data")

        # reformat unset parameters for consistency
        if not ZVector:
            ZVector = [None]
        if not Category:
            Category = [None]

        Beam = []
        Blank = []
        scene = Scene()

        if Centerline and Height and Width:
            # check list lengths for consistency
            N = len(Centerline)
            if len(ZVector) not in (0, 1, N):
                self.AddRuntimeMessage(
                    Error, " In 'ZVector' I need either none, one or the same number of inputs as the Crv parameter."
                )
            if len(Width) not in (1, N):
                self.AddRuntimeMessage(
                    Error, " In 'W' I need either one or the same number of inputs as the Crv parameter."
                )
            if len(Height) not in (1, N):
                self.AddRuntimeMessage(
                    Error, " In 'H' I need either one or the same number of inputs as the Crv parameter."
                )
            if len(Category) not in (0, 1, N):
                self.AddRuntimeMessage(
                    Error, " In 'Category' I need either none, one or the same number of inputs as the Crv parameter."
                )

            # duplicate data if None or single value
            if len(ZVector) != N:
                ZVector = [ZVector[0] for _ in range(N)]
            if len(Width) != N:
                Width = [Width[0] for _ in range(N)]
            if len(Height) != N:
                Height = [Height[0] for _ in range(N)]
            if len(Category) != N:
                Category = [Category[0] for _ in range(N)]

            for crv, z, w, h, c in zip(Centerline, ZVector, Width, Height, Category):
                if crv is None or w is None or h is None:
                    self.AddRuntimeMessage(Warning, "Some of the input values are Null")
                else:
                    line = rg.Line(crv.PointAtStart, crv.PointAtEnd)

                    line = line_to_compas(line)
                    if z:
                        z = vector_to_compas(z)
                    else:
                        None

                    beam = ctBeam.from_centerline(centerline=line, width=w, height=h, z_vector=z)

                    beam.attributes["rhino_guid"] = None
                    beam.attributes["category"] = c

                    Beam.append(beam)
                    scene.add(beam.blank)
        Blank = scene.redraw()

        return Beam, Blank
# ---------- end ct_beam ----------
ct_beam_2 = CT_Beam(Centerline=geo_5, ZVector=Vector(0, 0, 1), Width=0.2, Height=0.2)  # -> Beam, Blank; inputs Centerline: list of Curve, ZVector: list of Vector3d, Width: list, Height: list, Category: list; same code as ct_beam
ct_beam_3 = CT_Beam(Centerline=geo_6, ZVector=Vector(0, 1, 0), Width=0.1, Height=0.1, Category="end")  # -> Beam, Blank; inputs Centerline: list of Curve, ZVector: list of Vector3d, Width: list, Height: list, Category: list; same code as ct_beam
ct_beam_4 = CT_Beam(Centerline=geo_3, ZVector=Vector(0, 1, 0), Width=0.1, Height=0.1, Category="end")  # -> Beam, Blank; inputs Centerline: list of Curve, ZVector: list of Vector3d, Width: list, Height: list, Category: list; same code as ct_beam
Z = UnitZ(Factor=1)
beam = CTBeam(Centerline=geo, ZVector=Z, Width=number_slider, Height=number_slider)  # -> Beam, Blank; inputs Centerline: list of Guid, ZVector: list of Vector3d, Width: list, Height: list, Category: list, updateRefObj: Boolean
#   port Centerline: Referenced curve or line, Guid of curve or line in the active Rhino document.
#   port ZVector: Vector defining the orientation of the cross-section (corresponds to the height dimension). If None, a default will be taken.
#   port Width: Width of the cross-section (usually the smaller dimension).
#   port Height: Height of the cross-section (usually the larger dimension).
#   port Category: Category of a beam.
#   port updateRefObj: (optional) If True, the attributes in the referenced object will be updated/overwritten with the new values given here.
#   port Beam: Beam object(s).
#   port Blank: Shape of the beam's blank.
# ---------- beam: Python ----------
"""Creates a Beam from a LineCurve."""
from compas.geometry import Line
from compas.scene import Scene
from compas_rhino.conversions import curve_to_compas
from compas_rhino.conversions import vector_to_compas
from ghpythonlib.componentbase import executingcomponent as component
from Grasshopper.Kernel.GH_RuntimeMessageLevel import Error
from Grasshopper.Kernel.GH_RuntimeMessageLevel import Warning
from Rhino.RhinoDoc import ActiveDoc

from compas_timber.ghpython.rhino_object_name_attributes import update_rhobj_attributes_name
from compas_timber.parts import Beam as CTBeam


class Beam_fromCurve(component):
    def RunScript(self, Centerline, ZVector, Width, Height, Category, updateRefObj):
        # minimum inputs required
        if not Centerline:
            self.AddRuntimeMessage(Warning, "Input parameter 'Centerline' failed to collect data")
        if not Width:
            self.AddRuntimeMessage(Warning, "Input parameter 'Width' failed to collect data")
        if not Height:
            self.AddRuntimeMessage(Warning, "Input parameter 'Height' failed to collect data")

        # reformat unset parameters for consistency
        if not ZVector:
            ZVector = [None]
        if not Category:
            Category = [None]

        Beam = []
        Blank = []
        scene = Scene()

        if Centerline and Height and Width:
            # check list lengths for consistency
            N = len(Centerline)
            if len(ZVector) not in (0, 1, N):
                self.AddRuntimeMessage(
                    Error, " In 'ZVector' I need either none, one or the same number of inputs as the Crv parameter."
                )
            if len(Width) not in (1, N):
                self.AddRuntimeMessage(
                    Error, " In 'W' I need either one or the same number of inputs as the Crv parameter."
                )
            if len(Height) not in (1, N):
                self.AddRuntimeMessage(
                    Error, " In 'H' I need either one or the same number of inputs as the Crv parameter."
                )
            if len(Category) not in (0, 1, N):
                self.AddRuntimeMessage(
                    Error, " In 'Category' I need either none, one or the same number of inputs as the Crv parameter."
                )

            # duplicate data if None or single value
            if len(ZVector) != N:
                ZVector = [ZVector[0] for _ in range(N)]
            if len(Width) != N:
                Width = [Width[0] for _ in range(N)]
            if len(Height) != N:
                Height = [Height[0] for _ in range(N)]
            if len(Category) != N:
                Category = [Category[0] for _ in range(N)]

            for guid, z, w, h, c in zip(Centerline, ZVector, Width, Height, Category):
                curve = curve_to_compas(ActiveDoc.Objects.FindId(guid))
                line = Line(curve.start, curve.end)
                z = vector_to_compas(z) if z else None
                beam = CTBeam.from_centerline(centerline=line, width=w, height=h, z_vector=z)
                beam.attributes["rhino_guid"] = str(guid)
                beam.attributes["category"] = c

                if updateRefObj:
                    update_rhobj_attributes_name(guid, "width", str(w))
                    update_rhobj_attributes_name(guid, "height", str(h))
                    update_rhobj_attributes_name(guid, "zvector", str(list(beam.frame.zaxis)))
                    update_rhobj_attributes_name(guid, "category", c)

                Beam.append(beam)
                scene.add(beam.blank)

        Blank = scene.redraw()

        return Beam, Blank
# ---------- end beam ----------
beam_2 = CTBeam(Centerline=geo_2, ZVector=Z, Width=number_slider, Height=number_slider)  # -> Beam, Blank; inputs Centerline: list of Guid, ZVector: list of Vector3d, Width: list, Height: list, Category: list, updateRefObj: Boolean; same code as beam
beam_3 = CTBeam(Centerline=geo_7, ZVector=Z, Width=number_slider, Height=number_slider)  # -> Beam, Blank; inputs Centerline: list of Guid, ZVector: list of Vector3d, Width: list, Height: list, Category: list, updateRefObj: Boolean
#   port Centerline: Referenced curve or line, Guid of curve or line in the active Rhino document.
#   port ZVector: Vector defining the orientation of the cross-section (corresponds to the height dimension). If None, a default will be taken.
#   port Width: Width of the cross-section (usually the smaller dimension).
#   port Height: Height of the cross-section (usually the larger dimension).
#   port Category: Category of a beam.
#   port updateRefObj: (optional) If True, the attributes in the referenced object will be updated/overwritten with the new values given here.
#   port Beam: Beam object(s).
#   port Blank: Shape of the beam's blank.
# ---------- beam_3: Python ----------
"""Creates a Beam from a LineCurve."""

from compas.geometry import Line
from compas.scene import Scene
from compas_rhino.conversions import curve_to_compas
from compas_rhino.conversions import vector_to_compas
from ghpythonlib.componentbase import executingcomponent as component
from Grasshopper.Kernel.GH_RuntimeMessageLevel import Error
from Grasshopper.Kernel.GH_RuntimeMessageLevel import Warning
from Rhino.RhinoDoc import ActiveDoc

from compas_timber.ghpython.rhino_object_name_attributes import update_rhobj_attributes_name
from compas_timber.parts import Beam as CTBeam


class Beam_fromCurve(component):
    def RunScript(self, Centerline, ZVector, Width, Height, Category, updateRefObj):
        # minimum inputs required
        if not Centerline:
            self.AddRuntimeMessage(Warning, "Input parameter 'Centerline' failed to collect data")
        if not Width:
            self.AddRuntimeMessage(Warning, "Input parameter 'Width' failed to collect data")
        if not Height:
            self.AddRuntimeMessage(Warning, "Input parameter 'Height' failed to collect data")

        # reformat unset parameters for consistency
        if not ZVector:
            ZVector = [None]
        if not Category:
            Category = [None]

        Beam = []
        Blank = []
        scene = Scene()

        if Centerline and Height and Width:
            # check list lengths for consistency
            N = len(Centerline)
            if len(ZVector) not in (0, 1, N):
                self.AddRuntimeMessage(
                    Error, " In 'ZVector' I need either none, one or the same number of inputs as the Crv parameter."
                )
            if len(Width) not in (1, N):
                self.AddRuntimeMessage(
                    Error, " In 'W' I need either one or the same number of inputs as the Crv parameter."
                )
            if len(Height) not in (1, N):
                self.AddRuntimeMessage(
                    Error, " In 'H' I need either one or the same number of inputs as the Crv parameter."
                )
            if len(Category) not in (0, 1, N):
                self.AddRuntimeMessage(
                    Error, " In 'Category' I need either none, one or the same number of inputs as the Crv parameter."
                )

            # duplicate data if None or single value
            if len(ZVector) != N:
                ZVector = [ZVector[0] for _ in range(N)]
            if len(Width) != N:
                Width = [Width[0] for _ in range(N)]
            if len(Height) != N:
                Height = [Height[0] for _ in range(N)]
            if len(Category) != N:
                Category = [Category[0] for _ in range(N)]

            for guid, z, w, h, c in zip(Centerline, ZVector, Width, Height, Category):
                curve = curve_to_compas(ActiveDoc.Objects.FindId(guid))
                line = Line(curve.start, curve.end)
                z = vector_to_compas(z) if z else None
                beam = CTBeam.from_centerline(centerline=line, width=w, height=h, z_vector=z)
                beam.attributes["rhino_guid"] = str(guid)
                beam.attributes["category"] = c

                if updateRefObj:
                    update_rhobj_attributes_name(guid, "width", str(w))
                    update_rhobj_attributes_name(guid, "height", str(h))
                    update_rhobj_attributes_name(guid, "zvector", str(list(beam.frame.zaxis)))
                    update_rhobj_attributes_name(guid, "category", c)

                Beam.append(beam)
                scene.add(beam.blank)

        Blank = scene.draw()

        return Beam, Blank
# ---------- end beam_3 ----------
number_slider_2 = Slider(0.6, range=0..1)
t_half_lap = CTTHalfLapJointOptions()  # -> T_Half_Lap; inputs FlipLapSide: Boolean
#   port FlipLapSide: flip the side of the lap joint
# ---------- t_half_lap: Python ----------
from ghpythonlib.componentbase import executingcomponent as component

from compas_timber.connections import THalfLapJoint
from compas_timber.ghpython import JointOptions


class MyComponent(component):
    def RunScript(self, flip_lap_side, cut_plane_bias):
        args = {}
        if flip_lap_side:
            args["flip_lap_side"] = flip_lap_side
        if cut_plane_bias:
            args["cut_plane_bias"] = cut_plane_bias
        options = JointOptions(THalfLapJoint, **args)

        return options
# ---------- end t_half_lap ----------
relay = Relay([ct_beam_2.Beam, ct_beam.Beam, ct_beam_3.Beam, ct_beam_4.Beam])
relay_2 = Relay([beam.Beam, beam_2.Beam])

# ----
# Joint Application By Category
# Direct Joint Application
toggle = BooleanToggle(True)
jointsbycategory = CT_CategoryJointsRules(CatA="top", CatB="end")  # -> Rule; disabled
#   port JointOptions: Joint Options component.
# ---------- jointsbycategory: Python ----------
from ghpythonlib.componentbase import executingcomponent as component

from compas_timber.connections import LButtJoint
from compas_timber.connections import LMiterJoint
from compas_timber.connections import TButtJoint
from compas_timber.connections import XHalfLapJoint
from compas_timber.connections import FrenchRidgeLapJoint
from compas_timber.ghpython import CategoryRule


class CategoryJointRule(component):

    def RunScript(self, JointOptions, CatA, CatB):
        if JointOptions and CatA and CatB:
            return CategoryRule(JointOptions.type, CatA, CatB, **JointOptions.kwargs)
# ---------- end jointsbycategory ----------

# ----
# Joint Application By Category
toggle_2 = BooleanToggle(True)
jointsbycategory_2 = CT_CategoryJointsRules(CatA="top", CatB="end")  # -> Rule; same code as jointsbycategory

directjoints = CTDirectJointRules(JointOptions=t_half_lap, MainBeam=beam.Beam, SecondaryBeam=beam_2.Beam)  # -> Rule; inputs MainBeam: list, SecondaryBeam: list
#   port JointOptions: Joint Options Component
# ---------- directjoints: Python ----------
from ghpythonlib.componentbase import executingcomponent as component
from Grasshopper.Kernel.GH_RuntimeMessageLevel import Error
from Grasshopper.Kernel.GH_RuntimeMessageLevel import Warning

from compas_timber.connections import ConnectionSolver
from compas_timber.connections import JointTopology
from compas_timber.ghpython import DirectRule


class DirectJointRule(component):
    def RunScript(self, JointOptions, MainBeam, SecondaryBeam):
        if not MainBeam:
            self.AddRuntimeMessage(Warning, "Input parameter MainBeams failed to collect data.")
        if not SecondaryBeam:
            self.AddRuntimeMessage(Warning, "Input parameter CrossBeams failed to collect data.")
        if not (MainBeam and SecondaryBeam):
            return
        if not isinstance(MainBeam, list):
            MainBeam = [MainBeam]
        if not isinstance(SecondaryBeam, list):
            SecondaryBeam = [SecondaryBeam]
        if len(MainBeam) != len(SecondaryBeam):
            self.AddRuntimeMessage(Error, "Number of items in MainBeams and CrossBeams must match!")
            return
        Rules = []
        for main, secondary in zip(MainBeam, SecondaryBeam):
            topology, _, _ = ConnectionSolver().find_topology(main, secondary)
            if topology != JointOptions.type.SUPPORTED_TOPOLOGY:
                self.AddRuntimeMessage(
                    Warning,
                    "Beams meet with topology: {} which does not agree with joint of type: {}".format(
                        JointTopology.get_name(topology), JointOptions.type.__name__
                    ),
                )
                continue
            Rules.append(DirectRule(JointOptions.type, [secondary, main], **JointOptions.kwargs))
        return Rules
# ---------- end directjoints ----------
t_half_lap_2 = CTTHalfLapJointOptions()  # -> T_Half_Lap; inputs FlipLapSide: Boolean; same code as t_half_lap
l_half_lap = CTLHalfLapJointOptions()  # -> L_Half_Lap; inputs FlipLapSide: Boolean
#   port FlipLapSide: flip the side of the lap joint
# ---------- l_half_lap: Python ----------
from ghpythonlib.componentbase import executingcomponent as component


from compas_timber.connections import LHalfLapJoint
from compas_timber.ghpython import JointOptions


class MyComponent(component):
    def RunScript(self, flip_lap_side, cut_plane_bias):
        args = {}
        if flip_lap_side:
            args["flip_lap_side"] = flip_lap_side
        if cut_plane_bias:
            args["cut_plane_bias"] = cut_plane_bias

        options = JointOptions(LHalfLapJoint, **args)

        return options
# ---------- end l_half_lap ----------
jointsbytopo = CTTopologicalJointRules(L=l_half_lap, T=t_half_lap_2)  # -> Rules
#   port L: Joint type to be applied to L topology. Default type is L-Miter. Input is a joint options component.
# ---------- jointsbytopo: Python ----------
from ghpythonlib.componentbase import executingcomponent as component
from Grasshopper.Kernel.GH_RuntimeMessageLevel import Warning

from compas_timber.connections import JointTopology
from compas_timber.ghpython import TopologyRule

from compas_timber.connections import LMiterJoint
from compas_timber.connections import TButtJoint
from compas_timber.connections import XHalfLapJoint


class TopologyJointRule(component):
    def RunScript(self, L, T, X):
        topoRules = []

        if L:
            if L.type.SUPPORTED_TOPOLOGY != JointTopology.TOPO_L:
                self.AddRuntimeMessage(Warning, "Joint type does not match topology. Joint may not be generated.")
            topoRules.append(TopologyRule(JointTopology.TOPO_L, L.type, **L.kwargs))
        else:
            topoRules.append(TopologyRule(JointTopology.TOPO_L, LMiterJoint))
        if T:
            if T.type.SUPPORTED_TOPOLOGY != JointTopology.TOPO_T:
                self.AddRuntimeMessage(Warning, "Joint type does not match topology. Joint may not be generated.")
            topoRules.append(TopologyRule(JointTopology.TOPO_T, T.type, **T.kwargs))
        else:
            topoRules.append(TopologyRule(JointTopology.TOPO_T, TButtJoint))
        if X:
            if X.type.SUPPORTED_TOPOLOGY != JointTopology.TOPO_X:
                self.AddRuntimeMessage(Warning, "Joint type does not match topology. Joint may not be generated.")
            topoRules.append(TopologyRule(JointTopology.TOPO_X, X.type, **X.kwargs))
        else:
            topoRules.append(TopologyRule(JointTopology.TOPO_X, XHalfLapJoint))

        return topoRules
# ---------- end jointsbytopo ----------
directjoints_2 = CTDirectJointRules()  # -> Rule; inputs MainBeam: list, SecondaryBeam: list; same code as directjoints
assembly = CTAssembly(Beams=relay_2, JointRules=flatten(directjoints), CreateGeometry=Toggle(True))  # -> Assembly, Geometry; inputs Beams: list, JointRules: list, Features: list, CreateGeometry: Boolean
#   port Beams: Collection of Beams
# ---------- assembly: Python ----------
from compas.scene import Scene
from ghpythonlib.componentbase import executingcomponent as component
from Grasshopper.Kernel.GH_RuntimeMessageLevel import Warning

from compas_timber.assembly import TimberAssembly
from compas_timber.consumers import BrepGeometryConsumer
from compas_timber.connections import ConnectionSolver
from compas_timber.connections import JointTopology
from compas_timber.ghpython import JointDefinition
from compas_timber.ghpython import CategoryRule
from compas_timber.ghpython import TopologyRule
from compas_timber.ghpython import DirectRule


class Assembly(component):
    def __init__(self):
        # maintains relationship of old_beam.id => new_beam_obj for referencing
        # lets us modify copies of the beams while referencing them using their old identities.
        self._beam_map = {}

    def _get_copied_beams(self, old_beams):
        """For the given old_beams returns their respective copies."""
        new_beams = []
        for beam in old_beams:
            new_beams.append(self._beam_map[id(beam)])
        return new_beams

    def get_joints_from_rules(self, beams, rules, topologies):
        if not isinstance(rules, list):
            rules = [rules]
        rules = [r for r in rules if r is not None]

        joints = []
        # rules have to be resolved into joint definitions
        topo_rules = {}
        cat_rules = []
        direct_rules = []

        for r in rules:  # separate category and topo and direct joint rules
            if isinstance(r, TopologyRule):
                topo_rules[r.topology_type] = r
            elif isinstance(r, CategoryRule):
                cat_rules.append(r)
            if isinstance(r, DirectRule):
                direct_rules.append(r)

        for topo in topologies:
            beam_a = topo["beam_a"]
            beam_b = topo["beam_b"]
            detected_topo = topo["detected_topo"]
            pair = beam_a, beam_b
            pair_joined = False

            if detected_topo == JointTopology.TOPO_UNKNOWN:
                continue

            for rule in direct_rules:  # apply direct rules first
                if rule.comply(pair):
                    joints.append(JointDefinition(rule.joint_type, [beam_a, beam_b], **rule.kwargs))
                    pair_joined = True
                    break

            if not pair_joined:  # if no direct rule applies, apply category rules next
                for rule in cat_rules:
                    if not rule.comply(pair):
                        continue
                    if rule.joint_type.SUPPORTED_TOPOLOGY != detected_topo:
                        msg = "Conflict detected! Beams: {}, {} meet with topology: {} but rule assigns: {}"
                        self.AddRuntimeMessage(
                            Warning,
                            msg.format(
                                beam_a.key, beam_b.key, JointTopology.get_name(detected_topo), rule.joint_type.__name__
                            ),
                        )
                        continue
                    # sort by category to allow beam role by order (main beam first, cross beam second)
                    beam_a, beam_b = rule.reorder([beam_a, beam_b])
                    joints.append(JointDefinition(rule.joint_type, [beam_a, beam_b], **rule.kwargs))
                    break  # first matching rule

                else:  # no category rule applies, apply topology rules
                    if detected_topo not in topo_rules:
                        continue
                    else:
                        joints.append(
                            JointDefinition(
                                topo_rules[detected_topo].joint_type,
                                [beam_a, beam_b],
                                **topo_rules[detected_topo].kwargs
                            )
                        )
        return joints

    def RunScript(self, Beams, JointRules, Features, MaxDistance, CreateGeometry):
        if not Beams:
            self.AddRuntimeMessage(Warning, "Input parameter Beams failed to collect data")
        if not JointRules:
            self.AddRuntimeMessage(Warning, "Input parameter JointRules failed to collect data")
        if not (Beams):  # shows beams even if no joints are found
            return

        Assembly = TimberAssembly()

        topologies = []
        solver = ConnectionSolver()
        found_pairs = solver.find_intersecting_pairs(Beams, rtree=True, max_distance=MaxDistance)
        for pair in found_pairs:
            beam_a, beam_b = pair
            detected_topo, beam_a, beam_b = solver.find_topology(beam_a, beam_b, max_distance=MaxDistance)
            if not detected_topo == JointTopology.TOPO_UNKNOWN:
                topologies.append({"detected_topo": detected_topo, "beam_a": beam_a, "beam_b": beam_b})
        Assembly.set_topologies(topologies)

        self._beam_map = {}
        beams = [b for b in Beams if b is not None]
        for beam in beams:
            c_beam = beam.copy()
            Assembly.add_beam(c_beam)
            self._beam_map[id(beam)] = c_beam
        beams = Assembly.beams

        joints = self.get_joints_from_rules(beams, JointRules, topologies)

        if joints:
            handled_beams = []
            joints = [j for j in joints if j is not None]
            # apply reversed. later joints in orginal list override ealier ones
            for joint in joints[::-1]:
                beams_to_pair = self._get_copied_beams(joint.beams)
                beam_pair_ids = set([id(beam) for beam in beams_to_pair])
                if beam_pair_ids in handled_beams:
                    continue
                joint.joint_type.create(Assembly, *beams_to_pair, **joint.kwargs)
                handled_beams.append(beam_pair_ids)

        if Features:
            features = [f for f in Features if f is not None]
            for f_def in features:
                beams_to_modify = self._get_copied_beams(f_def.beams)
                for beam in beams_to_modify:
                    beam.add_feature(f_def.feature)

        Geometry = None
        scene = Scene()
        if joints and CreateGeometry:
            vis_consumer = BrepGeometryConsumer(Assembly)
            for result in vis_consumer.result:
                scene.add(result.geometry)
        else:
            for beam in beams:
                scene.add(beam.shape)
        Geometry = scene.redraw()

        return Assembly, Geometry
# ---------- end assembly ----------
series = Series(Start=0, Step=Slider(5, range=0..10), Count=Slider(5, range=0..10))
assembly_2 = CTAssembly(Beams=beam_3.Beam, JointRules=flatten(jointsbytopo), CreateGeometry=Toggle(True))  # -> Assembly, Geometry, DebugInfo; inputs Beams: list, JointRules: list, Features: list, CreateGeometry: Boolean
#   port Beams: Collection of Beams
# ---------- assembly_2: Python ----------
from compas.scene import Scene
from ghpythonlib.componentbase import executingcomponent as component
from Grasshopper.Kernel.GH_RuntimeMessageLevel import Warning

from compas_timber.assembly import TimberAssembly
from compas_timber.consumers import BrepGeometryConsumer
from compas_timber.connections import ConnectionSolver
from compas_timber.connections import JointTopology
from compas_timber.connections import BeamJoinningError
from compas_timber.ghpython import JointDefinition
from compas_timber.ghpython import CategoryRule
from compas_timber.ghpython import TopologyRule
from compas_timber.ghpython import DirectRule
from compas_timber.ghpython import DebugInfomation


class Assembly(component):
    def __init__(self):
        # maintains relationship of old_beam.id => new_beam_obj for referencing
        # lets us modify copies of the beams while referencing them using their old identities.
        self._beam_map = {}

    def _get_copied_beams(self, old_beams):
        """For the given old_beams returns their respective copies."""
        new_beams = []
        for beam in old_beams:
            new_beams.append(self._beam_map[id(beam)])
        return new_beams

    def get_joints_from_rules(self, beams, rules, topologies):
        if not isinstance(rules, list):
            rules = [rules]
        rules = [r for r in rules if r is not None]

        joints = []
        # rules have to be resolved into joint definitions
        topo_rules = {}
        cat_rules = []
        direct_rules = []

        for r in rules:  # separate category and topo and direct joint rules
            if isinstance(r, TopologyRule):
                topo_rules[r.topology_type] = r
            elif isinstance(r, CategoryRule):
                cat_rules.append(r)
            if isinstance(r, DirectRule):
                direct_rules.append(r)

        for topo in topologies:
            beam_a = topo["beam_a"]
            beam_b = topo["beam_b"]
            detected_topo = topo["detected_topo"]
            pair = beam_a, beam_b
            pair_joined = False

            if detected_topo == JointTopology.TOPO_UNKNOWN:
                continue

            for rule in direct_rules:  # apply direct rules first
                if rule.comply(pair):
                    joints.append(JointDefinition(rule.joint_type, [beam_a, beam_b], **rule.kwargs))
                    pair_joined = True
                    break

            if not pair_joined:  # if no direct rule applies, apply category rules next
                for rule in cat_rules:
                    if not rule.comply(pair):
                        continue
                    if rule.joint_type.SUPPORTED_TOPOLOGY != detected_topo:
                        msg = "Conflict detected! Beams: {}, {} meet with topology: {} but rule assigns: {}"
                        self.AddRuntimeMessage(
                            Warning,
                            msg.format(
                                beam_a.key, beam_b.key, JointTopology.get_name(detected_topo), rule.joint_type.__name__
                            ),
                        )
                        continue
                    # sort by category to allow beam role by order (main beam first, cross beam second)
                    beam_a, beam_b = rule.reorder([beam_a, beam_b])
                    joints.append(JointDefinition(rule.joint_type, [beam_a, beam_b], **rule.kwargs))
                    break  # first matching rule

                else:  # no category rule applies, apply topology rules
                    if detected_topo not in topo_rules:
                        continue
                    else:
                        joints.append(
                            JointDefinition(
                                topo_rules[detected_topo].joint_type,
                                [beam_a, beam_b],
                                **topo_rules[detected_topo].kwargs
                            )
                        )
        return joints

    def RunScript(self, Beams, JointRules, Features, MaxDistance, CreateGeometry):
        if not Beams:
            self.AddRuntimeMessage(Warning, "Input parameter Beams failed to collect data")
        if not JointRules:
            self.AddRuntimeMessage(Warning, "Input parameter JointRules failed to collect data")
        if not (Beams):  # shows beams even if no joints are found
            return

        Assembly = TimberAssembly()
        debug_info = DebugInfomation()

        topologies = []
        solver = ConnectionSolver()
        found_pairs = solver.find_intersecting_pairs(Beams, rtree=True, max_distance=MaxDistance)
        for pair in found_pairs:
            beam_a, beam_b = pair
            detected_topo, beam_a, beam_b = solver.find_topology(beam_a, beam_b, max_distance=MaxDistance)
            if not detected_topo == JointTopology.TOPO_UNKNOWN:
                topologies.append({"detected_topo": detected_topo, "beam_a": beam_a, "beam_b": beam_b})
        Assembly.set_topologies(topologies)

        self._beam_map = {}
        beams = [b for b in Beams if b is not None]
        for beam in beams:
            c_beam = beam.copy()
            Assembly.add_beam(c_beam)
            self._beam_map[id(beam)] = c_beam
        beams = Assembly.beams

        joints = self.get_joints_from_rules(beams, JointRules, topologies)

        if joints:
            handled_beams = []
            joints = [j for j in joints if j is not None]
            # apply reversed. later joints in orginal list override ealier ones
            for joint in joints[::-1]:
                beams_to_pair = self._get_copied_beams(joint.beams)
                beam_pair_ids = set([id(beam) for beam in beams_to_pair])
                if beam_pair_ids in handled_beams:
                    continue
                try:
                    joint.joint_type.create(Assembly, *beams_to_pair, **joint.kwargs)
                except BeamJoinningError as bje:
                    debug_info.add_joint_error(bje)
                else:
                    handled_beams.append(beam_pair_ids)

        if Features:
            features = [f for f in Features if f is not None]
            for f_def in features:
                beams_to_modify = self._get_copied_beams(f_def.beams)
                for beam in beams_to_modify:
                    beam.add_features(f_def.feature)

        Geometry = None
        scene = Scene()
        if CreateGeometry:
            vis_consumer = BrepGeometryConsumer(Assembly)
            for result in vis_consumer.result:
                scene.add(result.geometry)
                if result.debug_info:
                    debug_info.add_feature_error(result.debug_info)

        if debug_info.has_errors:
            self.AddRuntimeMessage(Warning, "Error found during joint creation. See DebugInfo output for details.")

        Geometry = scene.draw()
        return Assembly, Geometry, debug_info
# ---------- end assembly_2 ----------
geo_8 = Geometry([<brep referenced from the Rhino model> x8])
Z_2 = UnitZ(Factor=series)
toggle_3 = BooleanToggle(True)
showjointtypes = CTShowJointTypes(Assembly=assembly_2.Assembly)
#   port Assembly: Assembly object.
# ---------- showjointtypes: Python ----------
# flake8: noqa
import System
from compas_rhino.conversions import point_to_rhino
from ghpythonlib.componentbase import executingcomponent as component

from compas_timber.utils.compas_extra import intersection_line_line_3D


class ShowJointTypes(component):
    def RunScript(self, Assembly):
        self.pt = []
        self.txt = []

        if not Assembly:
            return

        for joint in Assembly.joints:
            line_a, line_b = joint.beams[0].centerline, joint.beams[1].centerline
            [p1, t1], [p2, t2] = intersection_line_line_3D(line_a, line_b, float("inf"), False, 1e-3)
            p1 = point_to_rhino(p1)
            p2 = point_to_rhino(p2)

            self.pt.append((p2 + p1) / 2)
            self.txt.append(joint.joint_type)

    def DrawViewportWires(self, arg):
        if self.Locked:
            return
        col = System.Drawing.Color.FromArgb(255, 0, 0, 0)
        # https://developer.rhino3d.com/api/RhinoCommon/html/M_Rhino_Display_DisplayPipeline_Draw2dText_5.htm
        for p, t in zip(self.pt, self.txt):
            arg.Display.Draw2dText(t, col, p, True, 12, "Verdana")
# ---------- end showjointtypes ----------
showtopo = CTShowTopologyTypes(Assembly=assembly_2.Assembly)
#   port Assembly: Assembly object.
# ---------- showtopo: Python ----------
# flake8: noqa
import System
from compas_rhino.conversions import point_to_rhino
from ghpythonlib.componentbase import executingcomponent as component
from compas_timber.connections import JointTopology
from compas_timber.utils.compas_extra import intersection_line_line_3D


class ShowTopologyTypes(component):
    def RunScript(self, Assembly):
        self.pt = []
        self.txt = []

        if not Assembly:
            return
        for topo in Assembly.topologies:
            beam_a = topo["beam_a"]
            beam_b = topo["beam_b"]
            topology = topo.get("detected_topo")

            [p1, _], [p2, _] = intersection_line_line_3D(
                beam_a.centerline, beam_b.centerline, float("inf"), False, 1e-3
            )
            p1 = point_to_rhino(p1)
            p2 = point_to_rhino(p2)
            self.pt.append((p2 + p1) / 2)
            self.txt.append(JointTopology.get_name(topology))

    def DrawViewportWires(self, arg):
        if self.Locked:
            return
        col = System.Drawing.Color.FromArgb(0, 0, 255, 0)
        # https://developer.rhino3d.com/api/RhinoCommon/html/M_Rhino_Display_DisplayPipeline_Draw2dText_5.htm
        for p, t in zip(self.pt, self.txt):
            arg.Display.Draw2dText(t, col, p, True, 12, "Verdana")
# ---------- end showtopo ----------
move = Move(Geometry=graft(geo_8), Motion=Z_2)  # -> Geometry, Transform
reset = Button()
python = GhPythonScript(reset=reset)  # -> out, a; inputs reset: Boolean
# ---------- python: Python ----------
__author__ = "obucklin"
__version__ = "2023.09.14"

import rhinoscriptsyntax as rs
from compas_ghpython import unload_modules

if reset:
    unload_modules("compas_timber")
# ---------- end python ----------

# ----
# Joint Application By Topology
number_slider_3 = Slider(0.5, range=0..1)

l_half_lap_2 = CTLHalfLapJointOptions(FlipLapSide=Toggle(True))  # -> L_Half_Lap; inputs FlipLapSide: Boolean; same code as l_half_lap

jointsbytopo_2 = CTTopologicalJointRules(L=l_half_lap_2)  # -> Joints
#   port L: Joint type to be applied to L topology. Default type is L-Miter. If L-Butt, the beam with a larger cross section area will be used as crossing beam.
# ---------- jointsbytopo_2: Python ----------
from ghpythonlib.componentbase import executingcomponent as component
from Grasshopper.Kernel.GH_RuntimeMessageLevel import Warning

from compas_timber.connections import JointTopology
from compas_timber.ghpython import TopologyRule

from compas_timber.connections import LMiterJoint
from compas_timber.connections import TButtJoint
from compas_timber.connections import XHalfLapJoint


class MyComponent(component):
    def RunScript(self, L, T, X):
        topoRules = []




        if L:
            if not L.type.SUPPORTED_TOPOLOGY == JointTopology.TOPO_L:
                self.AddRuntimeMessage(Warning, "Joint type does not match topology. Joint may not be generated.")
            topoRules.append(TopologyRule(JointTopology.TOPO_L, L.type, **L.kwargs))
        else:
            topoRules.append(TopologyRule(JointTopology.TOPO_L, LMiterJoint))
        if T:
            if not T.type.SUPPORTED_TOPOLOGY == JointTopology.TOPO_T:
                self.AddRuntimeMessage(Warning, "Joint type does not match topology. Joint may not be generated.")
            topoRules.append(TopologyRule(JointTopology.TOPO_T, T.type, **T.kwargs))
        else:
            topoRules.append(TopologyRule(JointTopology.TOPO_T, TButtJoint))
        if X:
            if not X.type.SUPPORTED_TOPOLOGY == JointTopology.TOPO_X:
                self.AddRuntimeMessage(Warning, "Joint type does not match topology. Joint may not be generated.")
            topoRules.append(TopologyRule(JointTopology.TOPO_X, X.type, **X.kwargs))
        else:
            topoRules.append(TopologyRule(JointTopology.TOPO_X, XHalfLapJoint))

        return topoRules
# ---------- end jointsbytopo_2 ----------

relay_3 = Relay([jointsbytopo_2, jointsbycategory, jointsbycategory_2])
assembly_3 = CTAssembly(Beams=relay, JointRules=flatten(relay_3), CreateGeometry=toggle_3)  # -> Assembly, Geometry; inputs Beams: list, JointRules: list, Features: list, CreateGeometry: Boolean
#   port Beams: Collection of Beams
# ---------- assembly_3: Python ----------
from ghpythonlib.componentbase import executingcomponent as component
from Grasshopper.Kernel.GH_RuntimeMessageLevel import Warning

from compas.scene import Scene
from compas_timber.assembly import TimberAssembly
from compas_timber.consumers import BrepGeometryConsumer
from compas_timber.connections import ConnectionSolver
from compas_timber.connections import JointTopology
from compas_timber.ghpython import JointDefinition
from compas_timber.ghpython import CategoryRule
from compas_timber.ghpython import TopologyRule
from compas_timber.ghpython import DirectRule


class Assembly(component):
    def __init__(self):
        # maintains relationship of old_beam.id => new_beam_obj for referencing
        # lets us modify copies of the beams while referencing them using their old identities.
        self._beam_map = {}

    def _get_copied_beams(self, old_beams):
        """For the given old_beams returns their respective copies."""
        new_beams = []
        for beam in old_beams:
            new_beams.append(self._beam_map[id(beam)])
        return new_beams

    def get_joint_definitions_from_rules(self, topologies, rules, ):
        if not isinstance(rules, list):
            rules = [rules]
        rules = [r for r in rules if r is not None]

        self.joints = []
        Info = []
        # rules have to be resolved into joint definitions
        topo_rules = {}
        cat_rules = []
        direct_rules = []

        for r in rules:  # separate category and topo and direct joint rules
            if isinstance(r, TopologyRule):
                topo_rules[r.topology_type] = r
            elif isinstance(r, CategoryRule):
                cat_rules.append(r)
            if isinstance(r, DirectRule):
                direct_rules.append(r)

        for topo in topologies:
            beam_a = topo["beam_a"]
            beam_b = topo["beam_b"]
            detected_topo = topo["detected_topo"]
            pair = beam_a, beam_b
            pair_joined = False

            if detected_topo == JointTopology.TOPO_UNKNOWN:
                continue

            for rule in direct_rules:  # apply direct rules first
                if rule.comply(pair):
                    self.joints.append(JointDefinition(rule.joint_type, [beam_a, beam_b], **rule.kwargs))
                    pair_joined = True
                    break

            if not pair_joined:  # if no direct rule applies, apply category rules next
                for rule in cat_rules:
                    if not rule.comply(pair):
                        continue
                    print("Beams meet with topology: {}  rule assigns: {}".format(
                    JointTopology.get_name(detected_topo), rule.joint_type.__name__)
)
                    if rule.joint_type.SUPPORTED_TOPOLOGY != detected_topo:
                        msg = "Conflict detected! Beams: {}, {} meet with topology: {} but rule assigns: {}"
                        Info.append(
                            msg.format(beam_a, beam_b, JointTopology.get_name(detected_topo), rule.joint_type.__name__)
                        )
                        continue
                    # sort by category to allow beam role by order (main beam first, cross beam second)
                    beam_a, beam_b = rule.reorder([beam_a, beam_b])
                    self.joints.append(JointDefinition(rule.joint_type, [beam_a, beam_b], **rule.kwargs))
                    break  # first matching rule

                else:  # no category rule applies, apply topology rules
                    if not detected_topo in topo_rules:
                        continue
                    else:
                        self.joints.append(
                            JointDefinition(
                                topo_rules[detected_topo].joint_type, [beam_a, beam_b], **topo_rules[detected_topo].kwargs
                            )
                        )

    def RunScript(self, Beams, JointRules, Features, MaxDistance, CreateGeometry):
        if not Beams:
            self.AddRuntimeMessage(Warning, "Input parameter Beams failed to collect data")
            pass
        if not JointRules:
            self.AddRuntimeMessage(Warning, "Input parameter JointRules failed to collect data")
        if not (Beams):
            return

        Assembly = TimberAssembly()

        topologies = []
        solver = ConnectionSolver()
        found_pairs = solver.find_intersecting_pairs(Beams, rtree=True, max_distance=MaxDistance)
        for pair in found_pairs:
            beam_a, beam_b = pair
            detected_topo, beam_a, beam_b = solver.find_topology(beam_a, beam_b, max_distance = MaxDistance)
            if not detected_topo == JointTopology.TOPO_UNKNOWN:
                topologies.append({"detected_topo": detected_topo, "beam_a": beam_a, "beam_b":beam_b})

        Assembly.set_topologies(topologies)
        self.get_joint_definitions_from_rules(topologies, JointRules)

        self._beam_map = {}
        beams = [b for b in Beams if b is not None]
        for beam in beams:
            c_beam = beam.copy()
            Assembly.add_beam(c_beam)
            self._beam_map[id(beam)] = c_beam
        beams = Assembly.beams

        if self.joints:
            handled_beams = []
            joints = [j for j in self.joints if j is not None]
            # apply reversed. later joints in orginal list override ealier ones
            for joint in joints[::-1]:
                beams_to_pair = self._get_copied_beams(joint.beams)
                beam_pair_ids = set([id(beam) for beam in beams_to_pair])
                if beam_pair_ids in handled_beams:
                    continue
                joint.joint_type.create(Assembly, *beams_to_pair, **joint.kwargs)
                handled_beams.append(beam_pair_ids)

        if Features:
            features = [f for f in Features if f is not None]
            for f_def in features:
                beams_to_modify = self._get_copied_beams(f_def.beams)
                for beam in beams_to_modify:
                    beam.add_feature(f_def.feature)

        Geometry = None
        scene = Scene()
        if CreateGeometry:
            vis_consumer = BrepGeometryConsumer(Assembly)
            for result in vis_consumer.result:
                scene.add(result.geometry)
        else:
            for beam in beams:
                scene.add(beam.shape)
        Geometry = scene.redraw()

        return Assembly, Geometry
# ---------- end assembly_3 ----------
assembly_4 = CTAssembly(Beams=relay, JointRules=flatten(relay_3), MaxDistance=Slider(0.5, range=0..1), CreateGeometry=toggle_3)  # -> Assembly, Geometry; inputs Beams: list, JointRules: list, Features: list, CreateGeometry: Boolean; same code as assembly
showtopo_2 = CTShowTopologyTypes(Assembly=assembly_3.Assembly)
#   port Assembly: Assembly object.
# ---------- showtopo_2: Python ----------
# flake8: noqa
import System
from compas_rhino.conversions import point_to_rhino
from ghpythonlib.componentbase import executingcomponent as component
from compas_timber.connections import JointTopology
from compas_timber.utils.compas_extra import intersection_line_line_3D


class ShowJointTypes(component):
    def RunScript(self, Assembly):
        self.pt = []
        self.txt = []

        if not Assembly:
            return
        for topo in Assembly.topologies:
            beam_a = topo.get("beam_a")
            beam_b = topo.get("beam_b")
            topology = topo.get("detected_topo")

            [p1, _], [p2, _] = intersection_line_line_3D(beam_a.centerline, beam_b.centerline, float("inf"), False, 1e-3)
            p1 = point_to_rhino(p1)
            p2 = point_to_rhino(p2)
            self.pt.append((p2 + p1) / 2)
            self.txt.append(JointTopology.get_name(topology))

    def DrawViewportWires(self, arg):
        if self.Locked:
            return
        col = System.Drawing.Color.FromArgb(255, 0, 0, 0)
        # https://developer.rhino3d.com/api/RhinoCommon/html/M_Rhino_Display_DisplayPipeline_Draw2dText_5.htm
        for p, t in zip(self.pt, self.txt):
            arg.Display.Draw2dText(t, col, p, True, 20, "Verdana")
# ---------- end showtopo_2 ----------
