# Grasshopper definition test_halflap.ghx (Grasshopper 1.0.7)

crv = Curve(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)
crv_2 = Curve(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)
crv_3 = Curve(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)
merge = Merge(Data1=crv_3, Data2=crv, Data3=crv_2)

# ---- group: FLIP
toggle = BooleanToggle(True)

toggle_2 = BooleanToggle(False)

# ---- group: UNITTEST
line = Line(Line((30396.14444, -3257.668213, 73.58395657), (34824.60961, -3257.668213, 73.58395657)))
crv_4 = Curve(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)
crv_5 = Curve(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)

# ---- group: CrossBeam
crv_6 = Curve(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)

# ----
flip = FlipCurve(Curve=crv_6)  # -> Curve, Flag
filter = StreamFilter(Gate=toggle_2, Stream0=crv_6, Stream1=flip.Curve)

flip_2 = FlipCurve(Curve=merge)  # -> Curve, Flag
filter_2 = StreamFilter(Gate=toggle, Stream0=merge, Stream1=flip_2.Curve)

line_2 = Line(filter)
line_3 = Line(filter_2)
crvprox = CurveProximity(CurveA=line_2, CurveB=line_3)  # -> PointA, PointB, Distance
xprod = CrossProduct(VectorA=line_2, VectorB=line_3, Unitize=False)  # -> Vector, Length
vdis = VectorDisplay(Anchor=crvprox.PointA, Vector=expr("x*100", xprod.Vector))
Y = UnitY(Factor=1)
Z = UnitZ(Factor=1)
X = UnitX(Factor=Slider(0.3, range=0..1))
addition = Addition(A=Z, B=X)
beam = CTBeam(Centerline=line_2, Width=Slider(60, range=0..100), Height=Slider(120, range=0..120))  # -> Beam, Blank; inputs Centerline: list, ZVector: list of Vector3d, Width: list, Height: list, Category: list, updateRefObj: Boolean
#   port Centerline: Referenced curve or line, Guid of curve or line in the active Rhino document.
#   port ZVector: Vector defining the orientation of the cross-section (corresponds to the height dimension). If None, a default will be taken.
#   port Width: Width of the cross-section (usually the smaller dimension).
#   port Height: Height of the cross-section (usually the larger dimension).
#   port Category: Category of a beam.
#   port updateRefObj: (optional) If True, the attributes in the referenced object will be updated/overwritten with the new values given here.
#   port Beam: Beam object(s).
#   port Blank: Shape of the beam's blank.
# ---------- beam: Python ----------
"""Creates a Beam from a LineCurve."""

import rhinoscriptsyntax as rs
from compas.scene import Scene
from compas_rhino.conversions import line_to_compas
from compas_rhino.conversions import vector_to_compas
from ghpythonlib.componentbase import executingcomponent as component
from Grasshopper.Kernel.GH_RuntimeMessageLevel import Error
from Grasshopper.Kernel.GH_RuntimeMessageLevel import Warning
from Rhino.RhinoDoc import ActiveDoc

from compas_timber.elements import Beam as CTBeam
from compas_timber.ghpython.rhino_object_name_attributes import update_rhobj_attributes_name


class Beam_fromCurve(component):
    def RunScript(self, centerline, z_vector, width, height, category, updateRefObj):
        # minimum inputs required
        if not centerline:
            self.AddRuntimeMessage(Warning, "Input parameter 'Centerline' failed to collect data")
        if not width:
            length = self._get_centerline_length(centerline)
            width = [length / 20]
        if not height:
            length = self._get_centerline_length(centerline)
            height = [length / 10]

        # reformat unset parameters for consistency
        if not z_vector:
            z_vector = [None]
        if not category:
            category = [None]

        beams = []
        blanks = []
        scene = Scene()

        if centerline and height and width:
            # check list lengths for consistency
            N = len(centerline)
            if len(z_vector) not in (0, 1, N):
                self.AddRuntimeMessage(
                    Error, " In 'ZVector' I need either none, one or the same number of inputs as the Crv parameter."
                )
            if len(width) not in (1, N):
                self.AddRuntimeMessage(
                    Error, " In 'W' I need either one or the same number of inputs as the Crv parameter."
                )
            if len(height) not in (1, N):
                self.AddRuntimeMessage(
                    Error, " In 'H' I need either one or the same number of inputs as the Crv parameter."
                )
            if len(category) not in (0, 1, N):
                self.AddRuntimeMessage(
                    Error, " In 'Category' I need either none, one or the same number of inputs as the Crv parameter."
                )

            # duplicate data if None or single value
            if len(z_vector) != N:
                z_vector = [z_vector[0] for _ in range(N)]
            if len(width) != N:
                width = [width[0] for _ in range(N)]
            if len(height) != N:
                height = [height[0] for _ in range(N)]
            if len(category) != N:
                category = [category[0] for _ in range(N)]

            for line, z, w, h, c in zip(centerline, z_vector, width, height, category):
                guid, geometry = self._get_guid_and_geometry(line)
                rhino_line = rs.coerceline(geometry)
                line = line_to_compas(rhino_line)

                z = vector_to_compas(z) if z else None
                beam = CTBeam.from_centerline(centerline=line, width=w, height=h, z_vector=z)
                beam.attributes["rhino_guid"] = str(guid) if guid else None
                beam.attributes["category"] = c
                print(guid)
                if updateRefObj and guid:
                    update_rhobj_attributes_name(guid, "width", str(w))
                    update_rhobj_attributes_name(guid, "height", str(h))
                    update_rhobj_attributes_name(guid, "zvector", str(list(beam.frame.zaxis)))
                    update_rhobj_attributes_name(guid, "category", c)

                beams.append(beam)
                scene.add(beam.blank)

        blanks = scene.draw()

        return beams, blanks

    def _get_guid_and_geometry(self, line):
        # internalized curves and GH geometry will not have persistent GUIDs, referenced Rhino objects will
        # type hint on the input has to be 'ghdoc' for this to work
        guid = None
        geometry = line
        rhino_obj = ActiveDoc.Objects.FindId(line)
        if rhino_obj:
            guid = line
            geometry = rhino_obj.Geometry
        return guid, geometry

    def _get_centerline_length(self, centerline):
        centerline_length = []
        for i in centerline:
            centerline_length.append(rs.CurveLength(i))
        if centerline_length:
            length_average = sum(centerline_length) / len(centerline_length)
        else:
            length_average = 1
        return length_average
# ---------- end beam ----------
beam_2 = CTBeam(Centerline=line_3, Width=Slider(80, range=0..100), Height=Slider(100, range=0..100))  # -> Beam, Blank; inputs Centerline: list, ZVector: list of Vector3d, Width: list, Height: list, Category: list, updateRefObj: Boolean; same code as beam

toggle_3 = BooleanToggle(True)
number_slider = Slider(0.2, range=0..1)
l_topo_joint = CTLTopologicalJointRules(modify_cross=toggle_3)  # -> LButtJoint
# ---------- l_topo_joint: Python ----------
import inspect

from ghpythonlib.componentbase import executingcomponent as component
from Grasshopper.Kernel.GH_RuntimeMessageLevel import Warning

from compas_timber.connections import Joint
from compas_timber.connections import JointTopology
from compas_timber.connections import LMiterJoint
from compas_timber.design import TopologyRule
from compas_timber.ghpython.ghcomponent_helpers import get_leaf_subclasses
from compas_timber.ghpython.ghcomponent_helpers import manage_dynamic_params
from compas_timber.ghpython.ghcomponent_helpers import rename_gh_output


class L_TopologyJointRule(component):
    def __init__(self):
        super(L_TopologyJointRule, self).__init__()
        self.classes = {}
        for cls in get_leaf_subclasses(Joint):
            if cls.SUPPORTED_TOPOLOGY == JointTopology.TOPO_L:
                self.classes[cls.__name__] = cls
        if ghenv.Component.Params.Output[0].NickName == "Rule":
            self.joint_type = LMiterJoint
            self.clicked = False
        else:
            self.joint_type = self.classes.get(ghenv.Component.Params.Output[0].NickName, None)
            self.clicked = True

    def RunScript(self, *args):
        if not self.clicked:
            ghenv.Component.Message = "Default: LMiterJoint"
            self.AddRuntimeMessage(Warning, "LMiterJoint is default, change in context menu (right click)")
            return TopologyRule(JointTopology.TOPO_L, LMiterJoint)
        else:
            ghenv.Component.Message = self.joint_type.__name__
            kwargs = {}
            for i, val in enumerate(args):
                if val is not None:
                    kwargs[self.arg_names()[i]] = val
            if self.joint_type.SUPPORTED_TOPOLOGY != JointTopology.TOPO_L:
                self.AddRuntimeMessage(Warning, "Joint type does not match topology. Joint may not be generated.")
            return TopologyRule(JointTopology.TOPO_L, self.joint_type, **kwargs)

    def arg_names(self):
        names = inspect.getargspec(self.joint_type.__init__)[0][3:]
        return [name for name in names if (name != "key") and (name != "frame")]

    def AppendAdditionalMenuItems(self, menu):
        for name in self.classes.keys():
            item = menu.Items.Add(name, None, self.on_item_click)
            if self.joint_type and name == self.joint_type.__name__:
                item.Checked = True

    def on_item_click(self, sender, event_info):
        self.clicked = True
        self.joint_type = self.classes[str(sender)]
        rename_gh_output(self.joint_type.__name__, 0, ghenv)
        manage_dynamic_params(self.arg_names(), ghenv, rename_count=0, permanent_param_count=0)
        ghenv.Component.ExpireSolution(True)
# ---------- end l_topo_joint ----------
x_topo_joint = CTXTopologicalJointRules(flip_lap_side=toggle_3, cut_plane_bias=number_slider)  # -> XHalfLapJoint
#   port flip_lap_side: flip_lap_side
# ---------- x_topo_joint: Python ----------
import inspect

from ghpythonlib.componentbase import executingcomponent as component
from Grasshopper.Kernel.GH_RuntimeMessageLevel import Warning

from compas_timber.connections import Joint
from compas_timber.connections import JointTopology
from compas_timber.connections import XHalfLapJoint
from compas_timber.design import TopologyRule
from compas_timber.ghpython.ghcomponent_helpers import get_leaf_subclasses
from compas_timber.ghpython.ghcomponent_helpers import manage_dynamic_params
from compas_timber.ghpython.ghcomponent_helpers import rename_gh_output


class X_TopologyJointRule(component):
    def __init__(self):
        super(X_TopologyJointRule, self).__init__()
        self.classes = {}
        for cls in get_leaf_subclasses(Joint):
            if cls.SUPPORTED_TOPOLOGY == JointTopology.TOPO_X:
                self.classes[cls.__name__] = cls
        if ghenv.Component.Params.Output[0].NickName == "Rule":
            self.joint_type = XHalfLapJoint
            self.clicked = False
        else:
            self.joint_type = self.classes.get(ghenv.Component.Params.Output[0].NickName, None)
            self.clicked = True

    def RunScript(self, *args):
        if not self.clicked:
            ghenv.Component.Message = "Default: XHalfLapJoint"
            self.AddRuntimeMessage(Warning, "XHalfLapJoint is default, change in context menu (right click)")
            return TopologyRule(JointTopology.TOPO_X, XHalfLapJoint)
        else:
            ghenv.Component.Message = self.joint_type.__name__
            kwargs = {}
            for i, val in enumerate(args):
                if val is not None:
                    kwargs[self.arg_names()[i]] = val
            if self.joint_type.SUPPORTED_TOPOLOGY != JointTopology.TOPO_X:
                self.AddRuntimeMessage(Warning, "Joint type does not match topology. Joint may not be generated.")
            return TopologyRule(JointTopology.TOPO_X, self.joint_type, **kwargs)

    def arg_names(self):
        names = inspect.getargspec(self.joint_type.__init__)[0][3:]
        return [name for name in names if (name != "key") and (name != "frame")]

    def AppendAdditionalMenuItems(self, menu):
        for name in self.classes.keys():
            item = menu.Items.Add(name, None, self.on_item_click)
            if self.joint_type and name == self.joint_type.__name__:
                item.Checked = True

    def on_item_click(self, sender, event_info):
        self.clicked = True
        self.joint_type = self.classes[str(sender)]
        rename_gh_output(self.joint_type.__name__, 0, ghenv)
        manage_dynamic_params(self.arg_names(), ghenv, rename_count=0, permanent_param_count=0)
        ghenv.Component.ExpireSolution(True)
# ---------- end x_topo_joint ----------
t_topo_joint = CTTTopologicalJointRules(mill_depth=Slider(20, range=0..100))  # -> TButtJoint
# ---------- t_topo_joint: Python ----------
import inspect

from ghpythonlib.componentbase import executingcomponent as component
from Grasshopper.Kernel.GH_RuntimeMessageLevel import Warning

from compas_timber.connections import Joint
from compas_timber.connections import JointTopology
from compas_timber.connections import TButtJoint
from compas_timber.design import TopologyRule
from compas_timber.ghpython.ghcomponent_helpers import get_leaf_subclasses
from compas_timber.ghpython.ghcomponent_helpers import manage_dynamic_params
from compas_timber.ghpython.ghcomponent_helpers import rename_gh_output


class T_TopologyJointRule(component):
    def __init__(self):
        super(T_TopologyJointRule, self).__init__()
        self.classes = {}
        for cls in get_leaf_subclasses(Joint):
            if cls.SUPPORTED_TOPOLOGY == JointTopology.TOPO_T:
                self.classes[cls.__name__] = cls
        if ghenv.Component.Params.Output[0].NickName == "Rule":
            self.joint_type = TButtJoint
            self.clicked = False
        else:
            self.joint_type = self.classes.get(ghenv.Component.Params.Output[0].NickName, None)
            self.clicked = True

    def RunScript(self, *args):
        if not self.clicked:
            ghenv.Component.Message = "Default: TButtJoint"
            self.AddRuntimeMessage(Warning, "TButtJoint is default, change in context menu (right click)")
            return TopologyRule(JointTopology.TOPO_T, TButtJoint)
        else:
            ghenv.Component.Message = self.joint_type.__name__
            kwargs = {}
            for i, val in enumerate(args):
                if val is not None:
                    kwargs[self.arg_names()[i]] = val
            if self.joint_type.SUPPORTED_TOPOLOGY != JointTopology.TOPO_T:
                self.AddRuntimeMessage(Warning, "Joint type does not match topology. Joint may not be generated.")
            return TopologyRule(JointTopology.TOPO_T, self.joint_type, **kwargs)

    def arg_names(self):
        names = inspect.getargspec(self.joint_type.__init__)[0][3:]
        return [name for name in names if (name != "key") and (name != "frame")]

    def AppendAdditionalMenuItems(self, menu):
        for name in self.classes.keys():
            item = menu.Items.Add(name, None, self.on_item_click)
            if self.joint_type and name == self.joint_type.__name__:
                item.Checked = True

    def on_item_click(self, sender, event_info):
        self.clicked = True
        self.joint_type = self.classes[str(sender)]
        rename_gh_output(self.joint_type.__name__, 0, ghenv)
        manage_dynamic_params(self.arg_names(), ghenv, rename_count=0, permanent_param_count=0)
        ghenv.Component.ExpireSolution(True)
# ---------- end t_topo_joint ----------
merge_2 = Merge(Data1=l_topo_joint, Data2=x_topo_joint, Data3=t_topo_joint)

merge_3 = Merge(Data1=beam.Beam, Data2=beam_2.Beam)
python = GhPythonScript(main_beam=beam.Beam, cross_beam=beam_2.Beam, bias=number_slider)  # -> out, cross_ref_side, main_ref_side, cross_cutting_plane, main_cutting_plane, cross_lap_frames, main_lap_frames, cross_volume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
# ---------- python: Python ----------
from compas_timber._fabrication import Lap
from compas_timber._fabrication import JackRafterCut
from compas.geometry import Plane
from compas_timber.connections.utilities import beam_ref_side_incidence_with_vector, beam_ref_side_incidence
from compas_rhino.conversions import frame_to_rhino, brep_to_rhino, plane_to_rhino, box_to_rhino, mesh_to_rhino
from compas_rhino import unload_modules

unload_modules('compas_timber')
cross_vect = cross_beam.centerline.direction.cross(main_beam.centerline.direction)
#cross
cross_ref_side_dict = beam_ref_side_incidence_with_vector(cross_beam, cross_vect, ignore_ends=True)
cross_ref_side_index = min(cross_ref_side_dict, key=cross_ref_side_dict.get)
# main 
main_ref_side_dict = beam_ref_side_incidence_with_vector(main_beam, cross_vect, ignore_ends=True)
main_ref_side_index = max(main_ref_side_dict, key=main_ref_side_dict.get)

#cuttng planes
def ortho_ref_side(beam_a, beam_b):
    ref_side_dict = beam_ref_side_incidence(beam_b, beam_a, ignore_ends=True)
    ref_side_index = max(ref_side_dict, key=ref_side_dict.get)
    return beam_a.ref_sides[ref_side_index]

def add_extensions(beam_a, beam_b, cutting_plane_a, cutting_plane_b):
    start_a, start_b = None, None
    start_a, end_a = beam_a.extension_to_plane(cutting_plane_b)
    start_b, end_b = beam_b.extension_to_plane(cutting_plane_a)

    beam_a.add_blank_extension(start_a, end_a, beam_a.guid)
    beam_b.add_blank_extension(start_b, end_b, beam_b.guid)

#main_cutting_plane = main_beam.ref_sides[(main_ref_side_index-1)%4]
#cross_cutting_plane = cross_beam.ref_sides[(cross_ref_side_index-1)%4]
main_cutting_plane = ortho_ref_side(main_beam, cross_beam)
cross_cutting_plane = ortho_ref_side(cross_beam, main_beam)

#add_extensions(cross_beam, main_beam, Plane.from_frame(cross_cutting_plane), Plane.from_frame(main_cutting_plane))

cross_lap_width = main_beam.width if main_ref_side_index % 2 == 0 else main_beam.height
main_lap_width = cross_beam.width if cross_ref_side_index % 2 == 0 else cross_beam.height
lap_depth = (cross_lap_width + main_lap_width) / 2

print(lap_depth*bias)
print(cross_beam.frame.normal)
### instanciate lap processing from plane and beam
cross_lap = Lap.from_plane_and_beam(main_cutting_plane, cross_beam, cross_lap_width, lap_depth*bias, ref_side_index=cross_ref_side_index)
print(cross_lap.start_x)
#cross_lap.slope = 5.0
cross_lap_planes = cross_lap.planes_from_params_and_beam(cross_beam)
cross_volume = cross_lap.volume_from_params_and_beam(cross_beam)
cross_geo = cross_beam.compute_geometry()
#cross_geo = cross_lap.apply(cross_geo, cross_beam)

#### instanciate lap processing from plane and beam
#main_lap = Lap.from_plane_and_beam(cross_cutting_plane, main_beam, main_lap_width, lap_depth*(1-bias), ref_side_index=main_ref_side_index)
##main_lap.slope = -5.0
##main_lap.inclination = 90.0
#main_lap_planes = main_lap.planes_from_params_and_beam(main_beam)
#main_volume = main_lap.volume_from_params_and_beam(main_beam)
#main_geo = main_beam.compute_geometry()
##main_geo = main_lap.apply(main_geo, main_beam)

###### vizualize
## viz ref_sides
#cross_ref_side = frame_to_rhino(cross_beam.ref_sides[cross_ref_side_index])
#main_ref_side = frame_to_rhino(main_beam.ref_sides[main_ref_side_index])
#
## viz cutting_planes
#main_cutting_plane = frame_to_rhino(main_cutting_plane)
#cross_cutting_plane = frame_to_rhino(cross_cutting_plane)
#
## viz lap frames
#main_lap_planes = [plane_to_rhino(plane) for plane in main_lap_planes]
#cross_lap_planes = [plane_to_rhino(plane) for plane in cross_lap_planes]
#
## viz volumes
#main_volume = mesh_to_rhino(main_volume)
#cross_volume = mesh_to_rhino(cross_volume)
#
## viz beams
rg_cross = brep_to_rhino(cross_geo)
#rg_main = brep_to_rhino(main_geo)
# ---------- end python ----------
panel = Panel(python.out)
model = CTModel(Elements=flatten(merge_3), JointRules=flatten(merge_2), CreateGeometry=Toggle(True))  # -> Model, Geometry, DebugInfo; inputs Elements: list, JointRules: list, Features: list, CreateGeometry: Boolean
#   port Elements: Collection of Beams
# ---------- model: Python ----------
from compas.scene import Scene
from compas.tolerance import TOL
from ghpythonlib.componentbase import executingcomponent as component
from Grasshopper.Kernel.GH_RuntimeMessageLevel import Warning

from compas_timber.connections import BeamJoinningError
from compas_timber.connections import ConnectionSolver
from compas_timber.connections import JointTopology
from compas_timber.connections import LMiterJoint
from compas_timber.connections import TButtJoint
from compas_timber.connections import XHalfLapJoint
from compas_timber.design import CategoryRule
from compas_timber.design import DebugInfomation
from compas_timber.design import DirectRule
from compas_timber.design import JointDefinition
from compas_timber.design import TopologyRule
from compas_timber.model import TimberModel

JOINT_DEFAULTS = {
    JointTopology.TOPO_X: XHalfLapJoint,
    JointTopology.TOPO_T: TButtJoint,
    JointTopology.TOPO_L: LMiterJoint,
}


# workaround for https://github.com/gramaziokohler/compas_timber/issues/280
TOL.absolute = 1e-6


class ModelComponent(component):
    def get_joints_from_rules(self, beams, rules, topologies):
        if not isinstance(rules, list):
            rules = [rules]
        rules = [r for r in rules if r is not None]

        joints = []
        # rules have to be resolved into joint definitions
        topo_rules = {}
        cat_rules = []
        direct_rules = []

        # TODO: refactor this into some kind of a rule reloving class/function
        for r in rules:  # separate category and topo and direct joint rules
            if isinstance(r, TopologyRule):
                if topo_rules.get(r.topology_type, None):  # if rule for this Topo exists
                    if (r.joint_type != JOINT_DEFAULTS[r.topology_type]) or (
                        len(r.kwargs) != 0
                    ):  # if this rule is NOT default
                        topo_rules[r.topology_type] = r
                else:
                    topo_rules[r.topology_type] = r
            elif isinstance(r, CategoryRule):
                cat_rules.append(r)
            if isinstance(r, DirectRule):
                direct_rules.append(r)

        for topo in topologies:
            beam_a = topo["beam_a"]
            beam_b = topo["beam_b"]
            detected_topo = topo["detected_topo"]
            pair = beam_a, beam_b
            pair_joined = False

            if detected_topo == JointTopology.TOPO_UNKNOWN:
                continue

            for rule in direct_rules:  # apply direct rules first
                if rule.comply(pair):
                    joints.append(JointDefinition(rule.joint_type, rule.beams, **rule.kwargs))
                    pair_joined = True
                    break

            if not pair_joined:  # if no direct rule applies, apply category rules next
                for rule in cat_rules:
                    if not rule.comply(pair):
                        continue
                    if rule.joint_type.SUPPORTED_TOPOLOGY != detected_topo:
                        msg = "Conflict detected! Beams: {}, {} meet with topology: {} but rule assigns: {}"
                        self.AddRuntimeMessage(
                            Warning,
                            msg.format(
                                beam_a.guid,
                                beam_b.guid,
                                JointTopology.get_name(detected_topo),
                                rule.joint_type.__name__,
                            ),
                        )
                        continue
                    if rule.topos and detected_topo not in rule.topos:
                        msg = "Conflict detected! Beams: {}, {} meet with topology: {} but rule allows: {}"
                        self.AddRuntimeMessage(
                            Warning,
                            msg.format(
                                beam_a.guid,
                                beam_b.guid,
                                JointTopology.get_name(detected_topo),
                                [JointTopology.get_name(topo) for topo in rule.topos],
                            ),
                        )
                        continue
                    # sort by category to allow beam role by order (main beam first, cross beam second)
                    beam_a, beam_b = rule.reorder([beam_a, beam_b])
                    joints.append(JointDefinition(rule.joint_type, [beam_a, beam_b], **rule.kwargs))
                    break  # first matching rule

                else:  # no category rule applies, apply topology rules
                    if detected_topo not in topo_rules:
                        continue
                    else:
                        joints.append(
                            JointDefinition(
                                topo_rules[detected_topo].joint_type,
                                [beam_a, beam_b],
                                **topo_rules[detected_topo].kwargs
                            )
                        )
        return joints

    def RunScript(self, Elements, JointRules, Features, MaxDistance, CreateGeometry):
        if not Elements:
            self.AddRuntimeMessage(Warning, "Input parameter Beams failed to collect data")
        if not JointRules:
            self.AddRuntimeMessage(Warning, "Input parameter JointRules failed to collect data")
        if not (Elements):  # shows beams even if no joints are found
            return
        if MaxDistance is None:
            MaxDistance = TOL.ABSOLUTE  # compared to calculted distance, so shouldn't be just 0.0

        Model = TimberModel()
        debug_info = DebugInfomation()
        for element in Elements:
            # prepare elements for downstream processing
            if element is None:
                continue
            element.remove_features()
            if hasattr(element, "remove_blank_extension"):
                element.remove_blank_extension()
            element.debug_info = []
            Model.add_element(element)

        topologies = []
        solver = ConnectionSolver()
        found_pairs = solver.find_intersecting_pairs(list(Model.beams), rtree=True, max_distance=MaxDistance)
        for pair in found_pairs:
            beam_a, beam_b = pair
            detected_topo, beam_a, beam_b = solver.find_topology(beam_a, beam_b, max_distance=MaxDistance)
            if not detected_topo == JointTopology.TOPO_UNKNOWN:
                topologies.append({"detected_topo": detected_topo, "beam_a": beam_a, "beam_b": beam_b})
        Model.set_topologies(topologies)

        joints = self.get_joints_from_rules(Model.beams, JointRules, topologies)

        if joints:
            handled_beams = []
            joints = [j for j in joints if j is not None]
            # apply reversed. later joints in orginal list override ealier ones
            for joint in joints[::-1]:
                beams_to_pair = joint.beams
                beam_pair_ids = set([id(beam) for beam in beams_to_pair])
                if beam_pair_ids in handled_beams:
                    continue
                try:
                    joint.joint_type.create(Model, *beams_to_pair, **joint.kwargs)
                except BeamJoinningError as bje:
                    debug_info.add_joint_error(bje)
                else:
                    handled_beams.append(beam_pair_ids)

        # applies extensions and features resulting from joints
        Model.process_joinery()

        if Features:
            features = [f for f in Features if f is not None]
            for f_def in features:
                for element in f_def.elements:
                    element.add_features(f_def.feature)

        Geometry = None
        scene = Scene()
        for element in Model.elements():
            if CreateGeometry:
                scene.add(element.geometry)
                if element.debug_info:
                    debug_info.add_feature_error(element.debug_info)
            else:
                scene.add(element.blank)

        if debug_info.has_errors:
            self.AddRuntimeMessage(Warning, "Error found during joint creation. See DebugInfo output for details.")

        Geometry = scene.draw()
        return Model, Geometry, debug_info
# ---------- end model ----------
joiningerrors = CTShowJoiningErrors(DebugInfo=model.DebugInfo, i=Slider(0, range=0..100))  # -> Info, Geometry
#   port DebugInfo: DebugInformation object containing joining errors.
# ---------- joiningerrors: Python ----------
# flake8: noqa
from compas.scene import SceneObject
from ghpythonlib.componentbase import executingcomponent as component
from Grasshopper.Kernel.GH_RuntimeMessageLevel import Warning


class ShowJoiningErrors(component):
    def RunScript(self, debug_info, index):
        if index is None:
            self.AddRuntimeMessage(Warning, "Input parameter 'i' failed to collect data")
            return
        if not debug_info:
            self.AddRuntimeMessage(Warning, "Input parameter 'DebugInfo' failed to collect data")
            return
        if not debug_info.joint_errors:
            self.AddRuntimeMessage(Warning, "No joining errors found in input parameter 'DebugInfo'")
            return
        joining_errors = debug_info.joint_errors
        index = int(index) % len(joining_errors)
        error = joining_errors[index]

        geometries = [beam.blank for beam in error.beams]
        geometries.extend(error.debug_geometries)
        geo_objs = [SceneObject(item=geo) for geo in geometries]
        output = []
        for obj in geo_objs:
            output.extend(obj.draw())

        return error.debug_info, output
# ---------- end joiningerrors ----------
panel_2 = Panel(joiningerrors.Info)
split = SplitList(List=model.Geometry, Index="1")  # -> ListA, ListB

# ---- group: ref_sides
pln = Plane(python.cross_ref_side)
pln_2 = Plane(python.main_ref_side)

# ---- group: cutting_planes
pln_3 = Plane(python.cross_cutting_plane)
pln_4 = Plane(python.main_cutting_plane)

# ---- group: lap_frames
pln_5 = Plane(python.cross_lap_frames)
pln_6 = Plane(python.main_lap_frames)

# ---- group: lap_volumes
mesh = Mesh(python.cross_volume)
mesh_2 = Mesh(python.main_volume)

# ---- group: beams
brep = Brep(python.rg_cross)
brep_2 = Brep(python.rg_main)

# ----
swatch = ColourSwatch(SwatchColor=RGBA(0, 13, 255, 40))  # disabled
swatch_2 = ColourSwatch(SwatchColor=RGBA(255, 0, 0, 40))  # disabled
preview = CustomPreview(Geometry=split.ListA, Material=swatch_2)  # disabled
preview_2 = CustomPreview(Geometry=split.ListB, Material=swatch)  # disabled
writebtlx = CTWriteBTLx(Model=model.Model, Path="C:\Users\kapso\OneDrive\Desktop\BTLx\HalfLapJoint.btlx", Write=Button())  # -> BTLx; inputs Write: Boolean
#   port Model: Model object.
# ---------- writebtlx: Python ----------
import Rhino
from ghpythonlib.componentbase import executingcomponent as component
from Grasshopper.Kernel.GH_RuntimeMessageLevel import Warning

from compas_timber.fabrication import BTLx


class WriteBTLx(component):
    def RunScript(self, model, path, write):
        if not model:
            self.AddRuntimeMessage(Warning, "Input parameter Model failed to collect data")
            return

        btlx = BTLx(model)
        btlx.history["FileName"] = Rhino.RhinoDoc.ActiveDoc.Name

        if write:
            if not path:
                self.AddRuntimeMessage(Warning, "Input parameter Path failed to collect data")
                return
            if path[-5:] != ".btlx":
                path += ".btlx"
            with open(path, "w") as f:
                f.write(btlx.btlx_string())
        return btlx.btlx_string()
# ---------- end writebtlx ----------
panel_3 = Panel(writebtlx)
