# Grasshopper definition test_tenon_mortise_joint.ghx (Grasshopper 1.0.7)

# ---- group: MainBeam
X = UnitX(Factor=Slider(500, range=0..4000))
Z = UnitZ(Factor=Slider(0, range=0..2000))
Y = UnitY(Factor=Slider(0, range=0..4000))

# ----
crv = Curve([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])

# ---- group: MainBeam
crv_2 = Curve(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)
end = EndPoints(Curve=crv_2)  # -> Start, End
addition = Addition(A=X, B=Z, C=Y)
move = Move(Geometry=end.End, Motion=addition)  # -> Geometry, Transform
ln = Line(StartPoint=end.Start, EndPoint=move.Geometry)

# ----
crv_3 = Curve(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)

# ---- group: CrossBeam
flipcurve = BooleanToggle(True)
crv_4 = Curve(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)

# ----
flipcurve_2 = BooleanToggle(True)
crv_5 = Curve(ln)

flip = FlipCurve(Curve=crv_4)  # -> Curve, Flag
filter = StreamFilter(Gate=flipcurve, Stream0=crv_4, Stream1=flip.Curve)
flip_2 = FlipCurve(Curve=crv_5)  # -> Curve, Flag
filter_2 = StreamFilter(Gate=flipcurve_2, Stream0=crv_5, Stream1=flip_2.Curve)

offset = BooleanToggle(False)  # disabled
cluster = Cluster_2(A=filter, line=filter_2, bool=offset, bool_2=flipcurve_2)  # -> s_0_2, s_0; disabled

Y_2 = UnitY(Factor=1)

# ---- group: UNITTEST
crv_6 = Curve([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])
cluster_2 = Cluster_3(centerline=crv_6, i=Slider(0, range=0..1))  # -> data_3, data_4

# ----
beam = CTBeam(Centerline=filter, Width=Slider(60, range=0..100), Height=Slider(100, range=0..1000))  # -> Beam, Blank; inputs Centerline: list, ZVector: list of Vector3d, Width: list, Height: list, Category: list, updateRefObj: Boolean; same code as beam
beam_2 = CTBeam(Centerline=filter_2, Width=Slider(120, range=0..1000), Height=Slider(100, range=0..100))  # -> Beam, Blank; inputs Centerline: list, ZVector: list of Vector3d, Width: list, Height: list, Category: list, updateRefObj: Boolean; same code as beam

length = Slider(82, range=0..200)
width = Slider(40, range=0..200)  # disabled
list = ValueList({"Automatic": 0, "Square": 1, "Round": 2, "Rounded": 3, "Radius": 4}, selected="Automatic")  # disabled
list_2 = ValueList({"Full": 0, "Offset": 1, "Shoulder": 2}, selected="Shoulder")
number_slider = Slider(-31, range=-100..100)  # disabled
number_slider_2 = Slider(5, range=0..100)  # disabled

python = GhPythonScript(main_beam=beam_2.Beam, cross_beam=beam.Beam)  # -> out, model; inputs house_type: Int32; disabled
# ---------- python: Python ----------
from compas_rhino import unload_modules
from compas_timber.model import TimberModel
from compas_timber.connections import TenonMortiseJoint

unload_modules('compas_timber')

model = TimberModel()
model.add_elements([main_beam, cross_beam])
tmj = TenonMortiseJoint.create(model, main_beam, cross_beam, house_type=house_type, house_depth=house_depth)

model.add_joint(tmj)
model.process_joinery()

geo = [beam.geometry for beam in model.beams]
# ---------- end python ----------
bang = ExplodeTree(Data=cluster_2.data_4)  # -> Branch0, Branch1, Branch2, Branch3, Branch4, Branch5, Branch6, Branch7

# ----
# DovetailTenon/Mortise
python_2 = GhPythonScript(
    cross_beam=beam.Beam,
    main_beam=beam_2.Beam,
    start_y=bang.Branch0,
    start_depth=bang.Branch1,
    rotation=bang.Branch2,
    length=bang.Branch3,
    width=bang.Branch4,
    height=bang.Branch5,
    shape=bang.Branch6,
    shape_radius=bang.Branch7)  # -> out, cutting_plane_tenon, cutting_plane_mortise, ref_side_main, ref_side_cross, mortise_btlx_params, tenon_btlx_params, geo_main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
# ---------- python_2: Python ----------
from compas_timber.fabrication import Tenon
from compas_timber.fabrication import Mortise
from compas_timber.fabrication import House
from compas_timber.fabrication import HouseMortise

from compas_timber.connections import Joint
from compas_timber.connections.utilities import beam_ref_side_incidence, beam_ref_side_incidence_with_vector, beam_ref_side_incidence_cross, point_centerline_towards_joint

from compas_timber.model import TimberModel
from compas_timber.fabrication import BTLxWriter

from compas.geometry import Point, intersection_line_line, angle_vectors, angle_vectors_signed, Frame, Vector

from compas_rhino import unload_modules
from compas.scene import SceneObject

import math

from compas_rhino.conversions import frame_to_rhino, plane_to_rhino, vector_to_rhino, surface_to_rhino, polyline_to_rhino, brep_to_rhino, point_to_rhino, surface_to_rhino

import Rhino.Geometry as rg
unload_modules("compas_timber")

geo_tenon = main_beam.compute_geometry(False)
geo_mortise = cross_beam.compute_geometry(False)

#define ref_sides
cross_ref_side_dict = beam_ref_side_incidence(main_beam, cross_beam, ignore_ends=True)
cross_ref_side_index = min(cross_ref_side_dict, key=cross_ref_side_dict.get)
print(cross_ref_side_index, "cross")

main_ref_side_dict = beam_ref_side_incidence(cross_beam, main_beam, ignore_ends=True)
main_ref_side_index = min(main_ref_side_dict, key=main_ref_side_dict.get)
print(main_ref_side_index, "main")

ref_side_main = frame_to_rhino(main_beam.ref_sides[main_ref_side_index])
ref_side_cross = frame_to_rhino(cross_beam.ref_sides[cross_ref_side_index])

#create dovetail_tenon
tenon = Tenon.from_plane_and_beam(
            cross_beam.ref_sides[cross_ref_side_index], 
            main_beam, 
            start_y=start_y, 
            rotation=rotation, 
            start_depth=start_depth, 
            width=width, 
            length=length,
            height=height,
            shape = shape,
            shape_radius = shape_radius,
            ref_side_index=main_ref_side_index,
        )
        
#print(tenon.ref_side_index)
#house = House.from_tenon(tenon, length, width, height)
#print(house.subprocessings)
##print(house.subprocesses.ref_side_index)
#house_params = house.params_dict
##print(house_params)
#
#main_beam.add_features(house)
##model = TimberModel()
##model.add_elements(main_beam)
##        
###cutting_frame
#cutting_plane_tenon= tenon.frame_from_params_and_beam(main_beam)
###tenon volume
##tenon_volume = tenon.volume_from_params_and_beam(main_beam)
##
###Mortise##
#mortise = Mortise.from_frame_and_beam(
#            frame=cutting_plane_tenon,
#            beam=cross_beam,
#            start_depth=0.0,
#            length=tenon.length,
#            width=tenon.width,
#            depth=tenon.height,
#            shape=tenon.shape,
#            shape_radius=tenon.shape_radius,
#            ref_side_index=cross_ref_side_index,
#        )
#
#house_mortise = HouseMortise.from_mortise(mortise, length, width, height)
##mortise_volume = house_mortise.volume_from_params_beam(cross_beam)
###cutting frame
#cutting_plane_mortise = house_mortise.frame_from_params_and_beam(cross_beam)
###mortise volue
#mortise_volume = house_mortise.volume_from_params_and_beam(cross_beam)
####get btlx params
##mortise_params = MortiseParams(mortise).as_dict()
##mortise_btlx_params = []
##for key, value in mortise_params.items():
##    mortise_btlx_params.append("{0}: {1}".format(key, value))
##
###get btlx params
##tenon_params = TenonParams(tenon).as_dict()
##print(tenon_params)
##tenon_btlx_params = []
##for key, value in tenon_params.items():
##    tenon_btlx_params.append("{0}: {1}".format(key, value))
##
###vizualize in rhino
##cutting_plane_tenon = frame_to_rhino(cutting_plane_tenon)
#cutting_plane_mortise = frame_to_rhino(cutting_plane_mortise)
##
##geo_tenon = brep_to_rhino(tenon_volume)
#geo_mortise = brep_to_rhino(mortise_volume)
##geo_main = brep_to_rhino(tenon.apply(main_beam.compute_geometry(), main_beam))
##geo_cross = brep_to_rhino(mortise.apply(cross_beam.compute_geometry(), cross_beam))
#
# ---------- end python_2 ----------
panel = Panel(python_2.out)
pln = Plane(python_2.cutting_plane_tenon)
pln_2 = Plane(python_2.cutting_plane_mortise)
pln_3 = Plane(python_2.ref_side_main)
pln_4 = Plane(python_2.ref_side_cross)
brep = Brep(python_2.geo_main)
brep_2 = Brep(python_2.geo_cross)

directjoints = CTDirectJointRules(
    main_beam=beam.Beam,
    cross_beam=beam_2.Beam,
    start_y=Slider(0, range=-10..10),
    start_depth=Slider(10, range=-10..10),
    rotation=number_slider,
    length=length,
    width=width,
    height=Slider(60, range=0..100),
    shape=list,
    shape_radius=number_slider_2,
    house_type=list_2,
    house_depth=Slider(12.63, range=0..100))  # -> TenonMortiseJoint; inputs main_beam: list, cross_beam: list
# ---------- directjoints: Python ----------
import inspect

from ghpythonlib.componentbase import executingcomponent as component
from Grasshopper.Kernel.GH_RuntimeMessageLevel import Error
from Grasshopper.Kernel.GH_RuntimeMessageLevel import Warning

from compas_timber.connections import ConnectionSolver
from compas_timber.connections import Joint
from compas_timber.connections import JointTopology
from compas_timber.design import DirectRule
from compas_timber.ghpython.ghcomponent_helpers import get_leaf_subclasses
from compas_timber.ghpython.ghcomponent_helpers import manage_dynamic_params
from compas_timber.ghpython.ghcomponent_helpers import rename_gh_output


class DirectJointRule(component):
    def __init__(self):
        super(DirectJointRule, self).__init__()
        self.classes = {}
        for cls in get_leaf_subclasses(Joint):
            if cls.MAX_ELEMENT_COUNT == 2:
                self.classes[cls.__name__] = cls

        if ghenv.Component.Params.Output[0].NickName == "Rule":
            self.joint_type = None
        else:
            self.joint_type = self.classes.get(ghenv.Component.Params.Output[0].NickName, None)

    def RunScript(self, *args):
        if not self.joint_type:
            ghenv.Component.Message = "Select joint type from context menu (right click)"
            self.AddRuntimeMessage(Warning, "Select joint type from context menu (right click)")
            return None
        else:
            ghenv.Component.Message = self.joint_type.__name__
            beam_a = args[0]
            beam_b = args[1]
            kwargs = {}
            for i, val in enumerate(args[2:]):
                if val is not None:
                    kwargs[self.arg_names()[i + 2]] = val

            if not beam_a:
                self.AddRuntimeMessage(Warning, "Input parameter {} failed to collect data.".format(self.arg_names()[0]))
            if not beam_b:
                self.AddRuntimeMessage(Warning, "Input parameter {} failed to collect data.".format(self.arg_names()[1]))
            if not (args[0] and args[1]):
                return
            if not isinstance(beam_a, list):
                beam_a = [beam_a]
            if not isinstance(beam_b, list):
                beam_b = [beam_b]
            if len(beam_a) != len(beam_b):
                self.AddRuntimeMessage(Error, "Number of items in {} and {} must match!".format(self.arg_names()[0], self.arg_names()[1]))
                return
            Rules = []
            for main, secondary in zip(beam_a, beam_b):
                topology, _, _ = ConnectionSolver().find_topology(main, secondary)
                supported_topo = self.joint_type.SUPPORTED_TOPOLOGY
                if not isinstance(supported_topo, list):
                    supported_topo = [supported_topo]
                if topology not in supported_topo:
                    self.AddRuntimeMessage(
                        Warning,
                        "Beams meet with topology: {} which does not agree with joint of type: {}".format(JointTopology.get_name(topology), self.joint_type.__name__),
                    )
                Rules.append(DirectRule(self.joint_type, [secondary, main], **kwargs))
            return Rules

    def arg_names(self):
        return inspect.getargspec(self.joint_type.__init__)[0][1:]

    def AppendAdditionalMenuItems(self, menu):
        for name in self.classes.keys():
            item = menu.Items.Add(name, None, self.on_item_click)
            if self.joint_type and name == self.joint_type.__name__:
                item.Checked = True

    def on_item_click(self, sender, event_info):
        self.joint_type = self.classes[str(sender)]
        rename_gh_output(self.joint_type.__name__, 0, ghenv)
        manage_dynamic_params(self.arg_names(), ghenv, rename_count=2, permanent_param_count=0)
        ghenv.Component.ExpireSolution(True)
# ---------- end directjoints ----------
brep_3 = Brep(python_2.geo_mortise)
brep_4 = Brep(python_2.geo_tenon)
merge = Merge(Data1=beam_2.Beam, Data2=beam.Beam)
mortise_btlx_params = Panel(python_2.mortise_btlx_params)
tenon_btlx_params = Panel(python_2.tenon_btlx_params)

# ----
# TDovetailJoint
number_slider_3 = Slider(60, range=0..100)

model = CTModel(Elements=flatten(merge), JointRules=flatten(directjoints), MaxDistance=number_slider_3, CreateGeometry=Toggle(True))  # -> Model, Geometry, DebugInfo; inputs Elements: list, JointRules: list, Features: list, CreateGeometry: Boolean
#   port Elements: Collection of Beams
# ---------- model: Python ----------
from compas.scene import Scene
from compas.tolerance import TOL
from ghpythonlib.componentbase import executingcomponent as component
from Grasshopper.Kernel.GH_RuntimeMessageLevel import Warning

from compas_timber.connections import JointTopology
from compas_timber.connections import LMiterJoint
from compas_timber.connections import TButtJoint
from compas_timber.connections import XHalfLapJoint
from compas_timber.design import DebugInfomation
from compas_timber.design import JointRule
from compas_timber.elements import Beam
from compas_timber.elements import Plate
from compas_timber.errors import BeamJoinningError
from compas_timber.model import TimberModel

JOINT_DEFAULTS = {
    JointTopology.TOPO_X: XHalfLapJoint,
    JointTopology.TOPO_T: TButtJoint,
    JointTopology.TOPO_L: LMiterJoint,
}

# workaround for https://github.com/gramaziokohler/compas_timber/issues/280
TOL.absolute = 1e-6


class ModelComponent(component):
    def RunScript(self, Elements, JointRules, Features, MaxDistance, CreateGeometry):
        if not Elements:
            self.AddRuntimeMessage(Warning, "Input parameter Beams failed to collect data")
        if not JointRules:
            self.AddRuntimeMessage(Warning, "Input parameter JointRules failed to collect data")
        if not (Elements):  # shows beams even if no joints are found
            return
        if MaxDistance is None:
            MaxDistance = TOL.ABSOLUTE  # compared to calculted distance, so shouldn't be just 0.0

        Model = TimberModel()
        debug_info = DebugInfomation()
        for element in Elements:
            # prepare elements for downstream processing
            element.reset()
            Model.add_element(element)

        joints, unmatched_pairs = JointRule.joints_from_beams_and_rules(Model.beams, JointRules, MaxDistance)

        if unmatched_pairs:
            for pair in unmatched_pairs:
                self.AddRuntimeMessage(Warning, "No joint rule found for beams {} and {}".format(list(pair)[0].key, list(pair)[1].key))  # TODO: add to debug_info

        if joints:
            # apply reversed. later joints in orginal list override ealier ones
            for joint in joints[::-1]:
                try:
                    joint.joint_type.create(Model, *joint.elements, **joint.kwargs)
                except BeamJoinningError as bje:
                    debug_info.add_joint_error(bje)

        # applies extensions and features resulting from joints
        Model.process_joinery()

        if Features:
            features = [f for f in Features if f is not None]
            for f_def in features:
                for element in f_def.elements:
                    element.add_features(f_def.feature)

        Geometry = None
        scene = Scene()
        for element in Model.elements():
            if CreateGeometry:
                scene.add(element.geometry)
                if element.debug_info:
                    debug_info.add_feature_error(element.debug_info)
            else:
                if isinstance(element, Beam) or isinstance(element, Plate):
                    scene.add(element.blank)
                else:
                    scene.add(element.geometry)

        if debug_info.has_errors:
            self.AddRuntimeMessage(Warning, "Error found during joint creation. See DebugInfo output for details.")

        Geometry = scene.draw()
        return Model, Geometry, debug_info
# ---------- end model ----------

featureerrors = CTShowFeatureErrors(DebugInfo=model.DebugInfo, i=Slider(0, range=0..100))  # -> Info, Geometry
#   port DebugInfo: DebugInformation object containing feature errors.
# ---------- featureerrors: Python ----------
# flake8: noqa
from compas.scene import SceneObject
from ghpythonlib.componentbase import executingcomponent as component
from Grasshopper.Kernel.GH_RuntimeMessageLevel import Warning


class ShowFeatureErrors(component):
    def RunScript(self, debug_info, index):
        if index is None:
            self.AddRuntimeMessage(Warning, "Input parameter 'i' failed to collect data")
            return
        if not debug_info:
            self.AddRuntimeMessage(Warning, "Input parameter 'DebugInfo' failed to collect data")
            return
        if not debug_info.feature_errors:
            self.AddRuntimeMessage(Warning, "No feature errors found in input parameter 'DebugInfo'")
            return
        feature_errors = debug_info.feature_errors
        index = int(index) % len(feature_errors)
        error = feature_errors[index]

        geometries = [error.feature_geometry, error.element_geometry]
        geo_objs = [SceneObject(item=geo) for geo in geometries]
        output = []
        for obj in geo_objs:
            output.extend(obj.draw())

        return error.message, output
# ---------- end featureerrors ----------
panel_2 = Panel(featureerrors.Info)

item = ListItem(List=reverse(model.Geometry), Index=0, Wrap=True)
writebtlx = CTWriteBTLx(Model=model.Model, Path="C:\Users\kapso\OneDrive\Desktop\BTLx\HouseTenonJoint3", Write=Button())  # -> BTLx; inputs Write: Boolean
#   port Model: Model object.
# ---------- writebtlx: Python ----------
import Rhino
from ghpythonlib.componentbase import executingcomponent as component
from Grasshopper.Kernel.GH_RuntimeMessageLevel import Warning

from compas_timber.fabrication import BTLxWriter


class WriteBTLx(component):
    def RunScript(self, model, path, write):
        if not model:
            self.AddRuntimeMessage(Warning, "Input parameter Model failed to collect data")
            return

        btlx = BTLxWriter(file_name=str(Rhino.RhinoDoc.ActiveDoc.Name))

        if write:
            if not path:
                self.AddRuntimeMessage(Warning, "Input parameter Path failed to collect data")
                return
            XML = btlx.write(model, path)
        else:
            XML = btlx.model_to_xml(model)

        return XML
# ---------- end writebtlx ----------
dispatch = Dispatch(List=model.Geometry, DispatchPattern=[True, False])  # -> ListA, ListB
panel_3 = Panel(writebtlx)
preview = CustomPreview(
    Geometry=dispatch.ListB,
    Material={diffuse=RGB(221, 160, 221), emission=RGB(66, 48, 66), shine=0.5, specular=RGB(255, 255, 255), transparency=0})

# ==== cluster Cluster_2
line = ClusterInput()
bool = ClusterInput()
bool_2 = ClusterInput()
Z = UnitZ(Factor=1)
line_2 = Line(line)
bool_3 = Boolean(bool)
cluster = Cluster(vec=Z, crv=line_2, bool=bool_2, num=Slider(2, range=0..20))  # -> C, num_4
A = ClusterInput()
filter = StreamFilter(Gate=bool_3, Stream0=line_2, Stream1=cluster.C)
xprod = CrossProduct(VectorA=A, VectorB=cluster.C, Unitize=False)  # -> Vector, Length
filter_2 = StreamFilter(Gate=bool_3, Stream1=xprod.Vector)
s_0 = ClusterOutput(filter)
s_0_2 = ClusterOutput(filter_2)

# ==== cluster Cluster_3

length = Slider(110, range=0..200)
width = Slider(40, range=0..200)

list = ValueList({"Automatic": "automatic", "Square": "square", "Round": "round", "Rounded": "rounded", "Radius": "radius"}, selected="Round")
width_2 = Slider(60, range=0..200)

list_2 = ValueList({"Automatic": "automatic", "Square": "square", "Round": "round", "Rounded": "rounded", "Radius": "radius"}, selected="Round")
length_2 = Slider(80, range=0..200)
width_3 = Slider(30, range=0..200)
width_4 = Slider(60, range=0..200)

centerline = ClusterInput()
panel = Panel("""80
120""")
panel_2 = Panel("""100
80""")
entwine = Entwine(
    Branch00=Slider(-5, range=-10..10),
    Branch01=Slider(-5, range=-20..20),
    Branch02=Slider(15, range=-100..100),
    Branch03=length_2,
    Branch04=width_3,
    Branch05=width_4,
    Branch06=list_2,
    Branch07=Slider(5, range=0..20),
    FlattenInputs=True)
entwine_2 = Entwine(
    Branch00=Slider(-7, range=-10..10),
    Branch01=Slider(2, range=-20..20),
    Branch02=Slider(-6, range=-100..100),
    Branch03=length,
    Branch04=width,
    Branch05=width_2,
    Branch06=list,
    Branch07=Slider(7.5, range=0..20),
    FlattenInputs=True)
beam = CTBeam(Centerline=centerline, Width=panel, Height=panel_2)  # -> Beam, Blank; inputs Centerline: list, ZVector: list of Vector3d, Width: list, Height: list, Category: list, updateRefObj: Boolean
#   port Centerline: Referenced curve or line, Guid of curve or line in the active Rhino document.
#   port ZVector: Vector defining the orientation of the cross-section (corresponds to the height dimension). If None, a default will be taken.
#   port Width: Width of the cross-section (usually the smaller dimension).
#   port Height: Height of the cross-section (usually the larger dimension).
#   port Category: Category of a beam.
#   port updateRefObj: (optional) If True, the attributes in the referenced object will be updated/overwritten with the new values given here.
#   port Beam: Beam object(s).
#   port Blank: Shape of the beam's blank.
# ---------- beam: Python ----------
"""Creates a Beam from a LineCurve."""

import rhinoscriptsyntax as rs
from compas.scene import Scene
from compas_rhino.conversions import line_to_compas
from compas_rhino.conversions import vector_to_compas
from ghpythonlib.componentbase import executingcomponent as component
from Grasshopper.Kernel.GH_RuntimeMessageLevel import Error
from Grasshopper.Kernel.GH_RuntimeMessageLevel import Warning
from Rhino.RhinoDoc import ActiveDoc

from compas_timber.elements import Beam as CTBeam
from compas_timber.ghpython.rhino_object_name_attributes import update_rhobj_attributes_name


class Beam_fromCurve(component):
    def RunScript(self, centerline, z_vector, width, height, category, updateRefObj):
        # minimum inputs required
        if not centerline:
            self.AddRuntimeMessage(Warning, "Input parameter 'Centerline' failed to collect data")
        if not width:
            length = self._get_centerline_length(centerline)
            width = [length / 20]
        if not height:
            length = self._get_centerline_length(centerline)
            height = [length / 10]

        # reformat unset parameters for consistency
        if not z_vector:
            z_vector = [None]
        if not category:
            category = [None]

        beams = []
        blanks = []
        scene = Scene()

        if centerline and height and width:
            # check list lengths for consistency
            N = len(centerline)
            if len(z_vector) not in (0, 1, N):
                self.AddRuntimeMessage(
                    Error, " In 'ZVector' I need either none, one or the same number of inputs as the Crv parameter."
                )
            if len(width) not in (1, N):
                self.AddRuntimeMessage(
                    Error, " In 'W' I need either one or the same number of inputs as the Crv parameter."
                )
            if len(height) not in (1, N):
                self.AddRuntimeMessage(
                    Error, " In 'H' I need either one or the same number of inputs as the Crv parameter."
                )
            if len(category) not in (0, 1, N):
                self.AddRuntimeMessage(
                    Error, " In 'Category' I need either none, one or the same number of inputs as the Crv parameter."
                )

            # duplicate data if None or single value
            if len(z_vector) != N:
                z_vector = [z_vector[0] for _ in range(N)]
            if len(width) != N:
                width = [width[0] for _ in range(N)]
            if len(height) != N:
                height = [height[0] for _ in range(N)]
            if len(category) != N:
                category = [category[0] for _ in range(N)]

            for line, z, w, h, c in zip(centerline, z_vector, width, height, category):
                guid, geometry = self._get_guid_and_geometry(line)
                rhino_line = rs.coerceline(geometry)
                line = line_to_compas(rhino_line)

                z = vector_to_compas(z) if z else None
                beam = CTBeam.from_centerline(centerline=line, width=w, height=h, z_vector=z)
                beam.attributes["rhino_guid"] = str(guid) if guid else None
                beam.attributes["category"] = c
                print(guid)
                if updateRefObj and guid:
                    update_rhobj_attributes_name(guid, "width", str(w))
                    update_rhobj_attributes_name(guid, "height", str(h))
                    update_rhobj_attributes_name(guid, "zvector", str(list(beam.frame.zaxis)))
                    update_rhobj_attributes_name(guid, "category", c)

                beams.append(beam)
                scene.add(beam.blank)

        blanks = scene.draw()

        return beams, blanks

    def _get_guid_and_geometry(self, line):
        # internalized curves and GH geometry will not have persistent GUIDs, referenced Rhino objects will
        # type hint on the input has to be 'ghdoc' for this to work
        guid = None
        geometry = line
        rhino_obj = ActiveDoc.Objects.FindId(line)
        if rhino_obj:
            guid = line
            geometry = rhino_obj.Geometry
        return guid, geometry

    def _get_centerline_length(self, centerline):
        centerline_length = []
        for i in centerline:
            centerline_length.append(rs.CurveLength(i))
        if centerline_length:
            length_average = sum(centerline_length) / len(centerline_length)
        else:
            length_average = 1
        return length_average
# ---------- end beam ----------
merge = Merge(Data1=entwine, Data2=entwine_2)
i = ClusterInput()
item = ListItem(List=beam.Beam, Index=i, Wrap=True)
item_2 = ListItem(List=merge, Index=i, Wrap=True)
data = Data(item_2)
data_2 = Data(item)
data_3 = ClusterOutput(data_2)
data_4 = ClusterOutput(data)

# ==== cluster Cluster
bool = ClusterInput()
vec = ClusterInput()
crv = ClusterInput()
bool_2 = Boolean(bool)
vec_2 = Vector(vec)
crv_2 = Curve(crv)
flip = FlipCurve(Curve=crv_2)  # -> Curve, Flag
filter = StreamFilter(Gate=bool_2, Stream0=crv_2, Stream1=flip.Curve)
end = EndPoints(Curve=crv_2)  # -> Start, End
end_2 = EndPoints(Curve=filter)  # -> Start, End
pt = Point(end_2.Start)
pi = Pi(Factor=1)  # -> expr("x/2", Output)
angle = Angle(VectorA=filter, VectorB=vec_2)  # -> Angle, Reflex
number_slider = Slider(100, range=0..100)
subtraction = Subtraction(A=pi, B=angle.Angle)
square_root = SquareRoot(Value=2)
deg = Degrees(Radians=subtraction)
panel = Panel(deg)
abs = Absolute(Value=subtraction)
expression = Expression(x=abs, y=number_slider, Expression="abs((y/2)/cos(x)+(tan(x)*(y/2)))-(y/2)")
Z = UnitZ(Factor=expression)
move = Move(Geometry=pt, Motion=Z)  # -> Geometry, Transform
ln = Line(StartPoint=move.Geometry, EndPoint=end_2.End)
angle_2 = Angle(VectorA=filter, VectorB=ln)  # -> Angle, Reflex
sine = Sine(Value=angle_2.Angle)
panel_2 = Panel(sine)
deg_2 = Degrees(Radians=angle_2.Angle)
multiplication = Multiplication(A=square_root, B=number_slider)
num = ClusterInput()
multiplication_2 = Multiplication(A=multiplication, B=sine)
num_2 = Number(num)
addition = Addition(A=expression, B=multiplication_2)
addition_2 = Addition(A=addition, B=num_2)
addition_3 = Addition(A=expression, B=multiplication_2)
Z_2 = UnitZ(Factor=addition_2)
larger = LargerThan(FirstNumber=subtraction, SecondNumber="0")  # -> LargerThan, OrEqualTo
subtraction_2 = Subtraction(A=expression, B=multiplication_2)
neg = Negative(Value=Z_2)
bool_3 = Boolean(larger.LargerThan)
filter_2 = StreamFilter(Gate=bool_3, Stream0=Z_2, Stream1=neg)
move_2 = Move(Geometry=pt, Motion=filter_2)  # -> Geometry, Transform
ln_2 = Line(StartPoint=move_2.Geometry, EndPoint=end_2.End)
num_3 = Number(expression)
crv_3 = Curve(ln_2)
flip_2 = FlipCurve(Curve=crv_3, Guide=crv_2)  # -> Curve, Flag
num_4 = ClusterOutput(num_3)
C = ClusterOutput(flip_2.Curve)
