# Grasshopper definition assembly_demo.gh (Grasshopper 1.0.7)

python_module_to_reload = Panel("""compas
compas_timber""")
reload = Button()
py = PythonScript(reload_module_button=reload, module_names=python_module_to_reload)  # inputs module_names: list
# ---------- py: Python ----------
import compas_ghpython
from compas_ghpython import unload_modules
if reload_module_button:
    for module in module_names:
        unload_modules(module)
# ---------- end py ----------
id = Guid([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])
vec = Vector(Vector(1, 0, 3))  # disabled
id_2 = Guid([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])
vec_2 = Vector(Vector(1, 0, 3))  # disabled
id_3 = Guid(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)
vec_3 = Vector(Vector(1, 0, 3))  # disabled
beam_from_line_vec = GhPythonScript(guid=id, vec=vec, W="0.1", H="0.2", update=Button())  # -> out, beam, shape; inputs guid: Guid, vec: Vector3d
# ---------- beam_from_line_vec: Python ----------
__author__ = "aapolina"
__version__ = "2021.12.10"


import Rhino.Geometry as rg
import rhinoscriptsyntax as rs
from compas_rhino.geometry import RhinoCurve

import Rhino

from compas_ghpython.utilities import unload_modules
from compas_timber.parts.beam import Beam
from compas_timber.utils.rhino_compas import rVec2cVec, cBox2rBox, rLine2cLine

import Rhino

crv = Rhino.RhinoDoc.ActiveDoc.Objects.FindId(guid).Geometry
line = rg.Line(crv.PointAtStart,crv.PointAtEnd)

v = rVec2cVec(vec) 
beam = Beam.from_centreline(rLine2cLine(line),rVec2cVec(vec),W,H)
beam.attributes['rhino_guid']=guid#.ToString()
shape = cBox2rBox(beam.shape)
# ---------- end beam_from_line_vec ----------
beam_from_line_vec_2 = GhPythonScript(guid=id_2, vec=vec_2, W="0.1", H="0.3", update=Button())  # -> out, beam, shape; inputs guid: Guid, vec: Vector3d; same code as beam_from_line_vec
beam_from_line_vec_3 = GhPythonScript(guid=id_3, vec=vec_3, W="0.1", H="0.3", update=Button())  # -> out, beam, shape; inputs guid: Guid, vec: Vector3d; same code as beam_from_line_vec

# ----
# assign categories to beams
category = ValueList({"A", "B", "C"}, selected="B")
category_2 = ValueList({"A", "B", "C"}, selected="C")
category_3 = ValueList({"A", "B", "C"}, selected="A")
python = GhPythonScript(beams=beam_from_line_vec_2.beam, category=category)  # -> out, beams; inputs beams: list
# ---------- python: Python ----------
__author__ = "aapolina"
__version__ = "2022.06.20"

import rhinoscriptsyntax as rs
from compas_timber.utils.rhino_grasshopper import update_rhinodocobject_name

for b in beams:
    b.attributes['category']=category
    update_rhinodocobject_name(b.attributes['rhino_guid'],"category:%s"%category)
# ---------- end python ----------
python_2 = GhPythonScript(beams=beam_from_line_vec_3.beam, category=category_2)  # -> out, beams; inputs beams: list; same code as python
# TODO:
# check if entry key already exists
python_3 = GhPythonScript(beams=beam_from_line_vec.beam, category=category_3)  # -> out, beams; inputs beams: list; same code as python

# ----
# make it work with string as guid
button = Button()
id_4 = Guid(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)
update_name = GhPythonScript(guid=id_4, name="tralala", update=button)  # -> out; inputs guid: Guid
# ---------- update_name: Python ----------
__author__ = "aapolina"
__version__ = "2021.12.10"

import Rhino

#https://developer.rhino3d.com/guides/rhinopython/ghpython-bake/
#https://www.grasshopper3d.com/forum/topics/changing-object-attributes-of-rhino-objects-in-gh


def update_rhinodocobject_name(guid,name):
    obj = Rhino.RhinoDoc.ActiveDoc.Objects.FindId(guid)
    att = Rhino.DocObjects.ObjectAttributes()
    att.Name = name
    obj.Attributes = att
    obj.CommitChanges()



update_rhinodocobject_name(guid,name)
# ---------- end update_name ----------

create_assembly = GhPythonScript(beams=[python.beams, python_3.beams, python_2.beams])  # -> out, model; inputs beams: list
# ---------- create_assembly: Python ----------
__author__ = "aapolina"
__version__ = "2022.04.27"

import rhinoscriptsyntax as rs
import scriptcontext as sc

from compas_timber.assembly.assembly import TimberAssembly
from compas_timber.connections.t_butt import TButtJoint 
from compas_timber.connections.t_lap import TLapJoint

model = TimberAssembly()

for i,beam in enumerate(beams): 
    beam.attributes['id']=i
    model.add_beam(beam)
# ---------- end create_assembly ----------

# ----
# define rules for joints
# between beams
# of given categories
category_4 = ValueList({"A", "B", "C"}, selected="B")
category_5 = ValueList({"A", "B", "C"}, selected="B")
list = ValueList({"T-Butt", "L-Butt", "L-Miter", "X-Lap"}, selected="X-Lap")
category_6 = ValueList({"A", "B", "C"}, selected="C")
category_7 = ValueList({"A", "B", "C"}, selected="B")
list_2 = ValueList({"T-Butt", "L-Butt", "L-Miter", "X-Lap"}, selected="T-Butt")
category_8 = ValueList({"A", "B", "C"}, selected="A")
list_3 = ValueList({"T-Butt", "L-Butt", "L-Miter", "X-Lap"}, selected="L-Miter")
category_9 = ValueList({"A", "B", "C"}, selected="A")
category_10 = ValueList({"A", "B", "C"}, selected="A")
category_11 = ValueList({"A", "B", "C"}, selected="C")
category_12 = ValueList({"A", "B", "C"}, selected="A")
list_4 = ValueList({"T-Butt", "L-Butt", "L-Miter", "X-Lap"}, selected="L-Miter")
list_5 = ValueList({"T-Butt", "L-Butt", "L-Miter", "X-Lap"}, selected="L-Miter")
category_13 = ValueList({"A", "B", "C"}, selected="B")
ghpython_script = GhPythonScript(category_beam1=category_4, category_beam2=category_5, default_joint_type=list)  # -> out, joint_rule
# ---------- ghpython_script: Python ----------
__author__ = "aapolina"
__version__ = "2022.06.20"

from compas_timber.connections.t_butt import TButtJoint
from compas_timber.connections.l_butt import LButtJoint
from compas_timber.connections.l_miter import LMiterJoint
from compas_timber.connections.x_lap import XLapJoint

import rhinoscriptsyntax as rs

joint_rule = [(category_beam1, category_beam2, default_joint_type)]
print joint_rule
# ---------- end ghpython_script ----------
ghpython_script_2 = GhPythonScript(category_beam1=category_6, category_beam2=category_9, default_joint_type=list_5)  # -> out, joint_rule; same code as ghpython_script
ghpython_script_3 = GhPythonScript(category_beam1=category_7, category_beam2=category_10, default_joint_type=list_2)  # -> out, joint_rule; same code as ghpython_script
ghpython_script_4 = GhPythonScript(category_beam1=category_8, category_beam2=category_11, default_joint_type=list_3)  # -> out, joint_rule; same code as ghpython_script
ghpython_script_5 = GhPythonScript(category_beam1=category_12, category_beam2=category_13, default_joint_type=list_4)  # -> out, joint_rule; same code as ghpython_script
data = Data([ghpython_script.joint_rule, ghpython_script_3.joint_rule, ghpython_script_4.joint_rule, ghpython_script_2.joint_rule, ghpython_script_5.joint_rule])
python_4 = GhPythonScript(joint_rule_defs=data)  # -> out, joint_rules_dict; inputs joint_rule_defs: list
# ---------- python_4: Python ----------
__author__ = "aapolina"
__version__ = "2022.06.21"

import rhinoscriptsyntax as rs

#Rephrase joint rules:
joint_rules_dict = {}
for jr in joint_rule_defs: 
    key = "%s+%s"%(jr[0],jr[1])
    if key in joint_rules_dict.keys():
        raise UserWarning("Conflicting rules detected for %s"%key)
    joint_rules_dict[key]=jr[2]
    
joint_rules_dict = [(joint_rules_dict )]
# ---------- end python_4 ----------

# ----
# 1) find line intersections
# 2) determine topology between two centrelines
# 3) find a matching joint rule
# 
# or issue a warning for conflicts or undefined situations
auto_find_joints = GhPythonScript(
    model=flatten(create_assembly.model),
    max_distance=flatten(Slider(0.2, range=0..1)),
    rules_dict=flatten(python_4.joint_rules_dict))  # -> out, topo_txt, model
# ---------- auto_find_joints: Python ----------
__author__ = "aapolina"
__version__ = "2022.04.07"

import rhinoscriptsyntax as rs

from compas_timber.utils.compas_extra import intersection_line_line_3D
from compas_timber.connections.t_butt import TButtJoint
from compas_timber.connections.l_miter import LMiterJoint
from compas_timber.connections.x_lap import XLapJoint
from compas_timber.utils.workflow import guess_joint_topology_2beams
import copy
#model = copy.deepcopy(model)

beams = model.beams

n = len(beams)

connections_txt = []
connectivity = {
'L':[],
'T':[],
'X':[]
}


# find what kind of joint topology it looks like based on centerlines
for i in range(n-1):
    for j in range(i+1,n):
        jointtype, beams_pair = guess_joint_topology_2beams(beams[i], beams[j], tol=1e-3)
        if jointtype:
            connectivity[jointtype].append(beams_pair)

topo_txt=""
for key in connectivity.keys():
    topo_txt+="%s: %s\n"%(key,[(bA.attributes['id'],bB.attributes['id']) for bA,bB in connectivity[key]])



#Apply default joint types depending on the auto-found connectivity type:

log_no_def = []
log_topo_mismatch = []


for beamA, beamB in connectivity['T']:
    catA, catB = (beamA.attributes['category'],beamB.attributes['category'])
    key = "%s+%s"%(catA,catB)
    try: joint_type = rules_dict[key]
    except: log_no_def.append(('T', catA, catB))
    else:
        if joint_type[0]!='T': 
            log_topo_mismatch.append(('T', catA, catB, beamA.attributes['id'], beamB.attributes['id'], rules_dict[key]))
        else:
            if joint_type == "T-Butt": TButtJoint(beamA, beamB, model)

for beamA, beamB in connectivity['L']:
    catA, catB = (beamA.attributes['category'],beamB.attributes['category'])
    key = "%s+%s"%(catA,catB)
    try: joint_type = rules_dict[key]
    except: log_no_def.append(('L', catA, catB))
    else:
        if joint_type[0]!='L': 
            log_topo_mismatch.append(('L', catA, catB, beamA.attributes['id'], beamB.attributes['id'], rules_dict[key]))
        else:
            if joint_type == "L-Butt": LButtJoint(beamA, beamB, model)
            if joint_type == "L-Miter": LMiterJoint(beamA, beamB, model)


for beamA, beamB in connectivity['X']:
    catA, catB = (beamA.attributes['category'],beamB.attributes['category'])
    key = "%s+%s"%(catA,catB)
    try: joint_type = rules_dict[key]
    except: log_no_def.append(('X', catA, catB))
    else:
        if joint_type[0]!='X': 
            log_topo_mismatch.append(('X', catA, catB, beamA.attributes['id'], beamB.attributes['id'], rules_dict[key]))
        else:
            if joint_type == "X-Lap": XLapJoint(beamA, beamB, model)



log_no_def = set(log_no_def)
log_topo_mismatch = set(log_topo_mismatch)


txt = "Connections found for which no matching rules were found:\n"
for t,b1,b2 in log_no_def:
    txt+="%s+%s with topology %s\n"%(b1,b2,t)

txt+="\nConnections found with a mismatch between rules and the actual topology:\n"
for t,c1,c2,b1,b2,d in log_topo_mismatch:
    txt+="%s+%s (%s+%s) is %s --> cannot apply %s\n"%(c1,c2,b1,b2,t,d)

print txt
# ---------- end auto_find_joints ----------
warnings = Panel(auto_find_joints.out)
panel = Panel(auto_find_joints.topo_txt)

joint_type_preview = GhPythonScript(model=auto_find_joints.model)  # -> out, joint_tag_pt, joint_tag_txt
# ---------- joint_type_preview: Python ----------
__author__ = "aapolina"
__version__ = "2022.04.27"

import rhinoscriptsyntax as rs
from compas_timber.utils.compas_extra import intersection_line_line_3D
from compas_timber.utils.rhino_compas import cPt2rPt
from compas_timber.parts.beam import Beam

joint_tag_pt = []
joint_tag_txt = []


print "%s joints found"%len(model.joints)

for joint in model.joints:
    #print joint.parts, type(joint.parts[0]), [part for part in joint.parts if type(part).__name__ == Beam.__name__]

    L1,L2 = [b.centreline for b in joint.beams]
    p1,p2 = intersection_line_line_3D(L1,L2, 0.2, False, False, 1e-3)
    print p1,p2, joint.joint_type
    p1 = cPt2rPt(p1)
    p2 = cPt2rPt(p2)
    
    joint_tag_pt.append((p2+p1)/2)
    joint_tag_txt.append(joint.joint_type)
# ---------- end joint_type_preview ----------
beam_id = GhPythonScript(model=auto_find_joints.model, t=Slider(0.08, range=0..1))  # -> out, pt, id; inputs beams: list
# ---------- beam_id: Python ----------
__author__ = "aapolina"
__version__ = "2022.03.15"

import rhinoscriptsyntax as rs
from compas_timber.utils.rhino_compas import cPt2rPt
from compas.geometry import Point
from compas.geometry import add_vectors

id = []
pt = []


def pt_on_centreline(beam,t):
    return Point(*add_vectors(beam.frame.point, beam.frame.xaxis*beam.length*t))

if not t: t=0.5

if model:
    beams = model.beams
    pt = [pt_on_centreline(beam,t) for beam in beams]
    id = [beam.key for beam in beams]
elif beams:
    pt = [pt_on_centreline(beam,t) for beam in beams]
    id = range(len(beams))
else:
    pass


pt = [cPt2rPt(p) for p in pt]
# ---------- end beam_id ----------
tag = TextTag(Location=beam_id.pt, Text=beam_id.id, Colour=RGB(255, 255, 255))
tag_2 = TextTag(Location=joint_type_preview.joint_tag_pt, Text=joint_type_preview.joint_tag_txt)
make_t_joints = GhPythonScript(model=auto_find_joints.model)  # -> out, model, trimmed_breps, box_breps, cutting_planes
# ---------- make_t_joints: Python ----------
__author__ = "aapolina"
__version__ = "2022.03.08"

import rhinoscriptsyntax as rs
from ghpythonlib.treehelpers import list_to_tree
import Rhino.Geometry as rg 

from compas.geometry import Point
from compas_timber.utils.rhino_compas import cPln2rPln, cBox2rBox


for beam in model.beams: beam.clear_features() 


for joint in model.joints:
    joint.add_feature()

box_breps = []
cutting_planes = []

boolsets = []

for beam in model.beams:
    box_brep= cBox2rBox(beam.shape).ToBrep()
    cplns = [cPln2rPln(feat[0]) for feat in beam.features if feat[1]=='trim']
    boolsets.append([box_brep, cplns])
    
    box_breps.append(box_brep)
    cutting_planes.extend(cplns)

x = []
for b,p in boolsets:
    if p:
        bi = b
        for pi in p:
            pi.Flip()
            bx = rg.Brep.Trim(bi,pi,1e-6)
            if len(bx)==0:
                print("trim failed - nothing trimmed?")
            elif len(bx)==1:
                bi=bx[0]
            else:
                print("%s parts after trimming - adding none"%len(bx))
        bi = bi.CapPlanarHoles(1e-6)
        x.append(bi)
    else:
        x.append(b)
        

trimmed_breps = x
# ---------- end make_t_joints ----------
geo = Geometry(make_t_joints.trimmed_breps)
brep = Brep(geo)

# ----
# bake with texture mapping
python_5 = GhPythonScript(model=make_t_joints.model)  # -> out, brep, beam_frame
# ---------- python_5: Python ----------
__author__ = "aapolina"
__version__ = "2022.03.11"

import rhinoscriptsyntax as rs
from compas_timber.utils.rhino_compas import cFrame2rPln, cBox2rBox



beam_frame = [cFrame2rPln(beam.frame) for beam in model.beams]


brep=[cBox2rBox(beam.shape) for beam in model.beams]
# ---------- end python_5 ----------
bake = _new(brep=flatten(brep), beam_frame=flatten(python_5.beam_frame), bake=Button())  # -> out, map_pln, Model; inputs brep: Brep, bake: Boolean
# ---------- bake: Python ----------
# -*- coding: utf-8 -*-
import Rhino.Geometry as rg
import scriptcontext as sc
import math
import copy
import Rhino.Render as rr
import rhinoscriptsyntax as rs
import Rhino
import random

def create_box_map(pln,sx,sy,sz):
    """
    pln: frame of beam box, where x=main axis, y=width, z=height
    sx,sy,sz: box map size in x,y,z direction
    """

    v = pln.YAxis
    w = pln.ZAxis
    pt = pln.Origin

    #random deviation 
    a = math.pi*0.5
    randangle = (random.random()-0.5)*a
    v.Rotate(randangle,pln.XAxis)
    
    b = math.pi*0.01
    randangle = (random.random()-0.5)*b
    w.Rotate(randangle,pln.XAxis)
    
    randpos = dimx*random.random()
    pt += pln.XAxis*randpos
    
    #create box mapping
    mappingPln = rg.Plane(pt, w, v)
    dx = rg.Interval(-sx*0.5,sx*0.5)
    dy = rg.Interval(-sy*0.5,sy*0.5)
    dz = rg.Interval(-sz*0.5,sz*0.5)

    BoxMap = Rhino.Render.TextureMapping.CreateBoxMapping(mappingPln, dx, dy, dz, False)

    return BoxMap, mappingPln


if not map_size:
    #for the pine 251 material bitmap, rotated
    dimx = 0.2
    dimy = 0.2
    dimz = 1.0
else:
    dimx,dimy,dimz = map_size

if bake:
    rs.EnableRedraw(False)
    sc.doc = Rhino.RhinoDoc.ActiveDoc

    attributes = None
    guid = sc.doc.Objects.Add(brep, attributes)

    boxmap,map_pln = create_box_map(beam_frame,dimx,dimy,dimz)
    sc.doc.Objects.ModifyTextureMapping(guid, 1, boxmap)

else:

    sc.doc = ghdoc
    rs.EnableRedraw(True)
    rs.Redraw()
# ---------- end bake ----------

preview = CustomPreview(Geometry=brep, Material=ColourSwatch(SwatchColor=RGB(196, 196, 196)))
