# Grasshopper definition beam.gh (Grasshopper 1.0.7)

number_slider = Slider(0.12, range=0..1)
number_slider_2 = Slider(0.19, range=0..1)
pt = Point(Point(0, 0, 0))
vec = Vector(Vector(-1, 1, 0))  # disabled
pt_2 = Point(Point(5, 0, 0))
vdis = VectorDisplay(Anchor=pt, Vector=vec)
pln = Plane(Plane(origin=(-2, 0, 0), x=(0.8320502943, -0.5547001962, 0), y=(0.3922322703, 0.5883484054, 0.7071067812)))
ln = Line(StartPoint=pt, EndPoint=pt_2)
beam_from_points_vec = GhPythonScript(ps=pt, pe=pt_2, vec=vec, W=number_slider, H=number_slider_2)  # -> out, beam, shape; inputs ps: Point3d, pe: Point3d, vec: Vector3d
# ---------- beam_from_points_vec: Python ----------
__author__ = "aapolina"
__version__ = "2021.12.10"

import Rhino.Geometry as rg
from compas_ghpython.utilities import unload_modules


import compas_timber
reload(compas_timber)
unload_modules('compas_timber')
from compas_timber.elements.beam2 import Beam
from compas_timber.utils.rhino_compas import rVec2cVec, rPt2cPt, cBox2rBox

beam = Beam.from_endpoints(rPt2cPt(ps), rPt2cPt(pe), rVec2cVec(vec),W,H)
shape = cBox2rBox(beam.shape)
# ---------- end beam_from_points_vec ----------
beam_from_line_vec = GhPythonScript(line=ln, vec=vec, W=number_slider, H=number_slider_2)  # -> out, beam, shape; inputs line: Line, vec: Vector3d
# ---------- beam_from_line_vec: Python ----------
__author__ = "aapolina"
__version__ = "2021.12.10"

from compas_ghpython.utilities import unload_modules
import Rhino.Geometry as rg

import compas_timber
reload(compas_timber)
unload_modules('compas_timber')
from compas_timber.elements.beam2 import Beam
from compas_timber.utils.rhino_compas import rVec2cVec, cBox2rBox, rLine2cLine

v = rVec2cVec(vec) 

beam = Beam.from_centreline(rLine2cLine(line),rVec2cVec(vec),W,H)
shape = cBox2rBox(beam.shape)
# ---------- end beam_from_line_vec ----------
beam_from_frame = GhPythonScript(pln=pln, W=number_slider, H=number_slider_2, L=Slider(2.68, range=0..10))  # -> out, beam, shape; inputs pln: Plane
# ---------- beam_from_frame: Python ----------
__author__ = "aapolina"
__version__ = "2021.12.10"

import Rhino.Geometry as rg
import compas_timber
from compas_timber.elements.beam2 import Beam
from compas_timber.utils.rhino_compas import rPln2cFrame, cBox2rBox
from compas_ghpython import unload_modules
unload_modules('compas_timber')
reload(compas_timber)

beam = Beam(rPln2cFrame(pln),L,W,H)

beam = Beam.from_frame(rPln2cFrame(pln),W,H,L)


shape = cBox2rBox(beam.shape)
# ---------- end beam_from_frame ----------
vec_2 = Vector(Vector(5, 2, 0))
vec_3 = Vector(Vector(1, 0, 2))
move = GhPythonScript(beam=beam_from_line_vec.beam, vec_start=vec_2)  # -> out, beam, shape; inputs vec_start: Vector3d, vec_end: Vector3d
# ---------- move: Python ----------
__author__ = "aapolina"
__version__ = "2021.12.17"



import rhinoscriptsyntax as rs
from compas_timber.utils.rhino_compas import rVec2cVec, cBox2rBox

beam = beam.copy()

if vec_start: 
    vec_start = rVec2cVec(vec_start)
    beam.move_endpoint(vec_start,'start')

if vec_end:
    vec_end = rVec2cVec(vec_end)
    beam.move_endpoint(vec_end,'end')

shape = cBox2rBox(beam.shape)
# ---------- end move ----------
orient = GhPythonScript(beam=beam_from_frame.beam, vec=vec_3)  # -> out, beam, shape; inputs vec: Vector3d
# ---------- orient: Python ----------
__author__ = "aapolina"
__version__ = "2021.12.17"

beam = beam.copy()

import rhinoscriptsyntax as rs
from compas_timber.utils.rhino_compas import rVec2cVec, cBox2rBox
vec = rVec2cVec(vec)

beam.align_z(vec)
shape = cBox2rBox(beam.shape)
# ---------- end orient ----------
