# Grasshopper definition test_dovetail.ghx (Grasshopper 1.0.7)
# plug-ins: Human, Heteroptera, froGH

X = UnitX(Factor=expr("-x", Slider(300, range=0..4000)))
Z = UnitZ(Factor=Slider(300, range=0..2000))
Y = UnitY(Factor=Slider(0, range=0..4000))

crv = Curve(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)
end = EndPoints(Curve=crv)  # -> Start, End
addition = Addition(A=X, B=Z, C=Y)
move = Move(Geometry=end.End, Motion=expr("-x", addition))  # -> Geometry, Transform
ln = Line(StartPoint=end.Start, EndPoint=move.Geometry)

number_slider = Slider(0, range=0..4000)

flipcurve = BooleanToggle(False)
crv_2 = Curve(ln)

Z_2 = UnitZ(Factor=1)

# ---- group: CrossBeam
crv_3 = Curve(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)

# ----
Z_3 = UnitZ(Factor=number_slider)
Y_2 = UnitY(Factor=number_slider)
move_2 = Move(Geometry=crv_2, Motion=Z_3)  # -> Geometry, Transform
xprod = CrossProduct(VectorA=crv_3, VectorB=crv_2, Unitize=False)  # -> Vector, Length
dprod = DotProduct(VectorA=xprod.Vector, VectorB=Z_2, Unitize=False)
larger = LargerThan(FirstNumber=dprod, SecondNumber="0")  # -> LargerThan, OrEqualTo
neg = Negative(Value=xprod.Vector)
pln = Plane(crv_2)
filter = StreamFilter(Gate=larger.LargerThan, Stream0=neg, Stream1=xprod.Vector)
vdis = VectorDisplay(Anchor=end.Start, Vector=expr("x*75", [filter, Z_2]))
flip = FlipCurve(Curve=move_2.Geometry)  # -> Curve, Flag
number_slider_2 = Slider(100, range=0..100)
number_slider_3 = Slider(100, range=0..100)
vdis_2 = VectorDisplay(Anchor=end.Start, Vector=expr("x*75", filter))
angle = Angle(VectorA=filter, VectorB=Z_2, Plane=pln)  # -> Angle, Reflex
filter_2 = StreamFilter(Gate=flipcurve, Stream0=move_2.Geometry, Stream1=flip.Curve)
deg = Degrees(Radians=angle.Angle)
subtraction = Subtraction(A=Slider(360, range=0..1000), B=deg)
beam = CTBeam(Centerline=crv_3, ZVector=Z_2, Width=number_slider_2, Height=number_slider_2)  # -> Beam, Blank; inputs Centerline: list, ZVector: list of Vector3d, Width: list, Height: list, Category: list, updateRefObj: Boolean
#   port Centerline: Referenced curve or line, Guid of curve or line in the active Rhino document.
#   port ZVector: Vector defining the orientation of the cross-section (corresponds to the height dimension). If None, a default will be taken.
#   port Width: Width of the cross-section (usually the smaller dimension).
#   port Height: Height of the cross-section (usually the larger dimension).
#   port Category: Category of a beam.
#   port updateRefObj: (optional) If True, the attributes in the referenced object will be updated/overwritten with the new values given here.
#   port Beam: Beam object(s).
#   port Blank: Shape of the beam's blank.
# ---------- beam: Python ----------
"""Creates a Beam from a LineCurve."""

import rhinoscriptsyntax as rs
from compas.scene import Scene
from compas_rhino.conversions import line_to_compas
from compas_rhino.conversions import vector_to_compas
from ghpythonlib.componentbase import executingcomponent as component
from Grasshopper.Kernel.GH_RuntimeMessageLevel import Error
from Grasshopper.Kernel.GH_RuntimeMessageLevel import Warning
from Rhino.RhinoDoc import ActiveDoc

from compas_timber.elements import Beam as CTBeam
from compas_timber.ghpython.rhino_object_name_attributes import update_rhobj_attributes_name


class Beam_fromCurve(component):
    def RunScript(self, centerline, z_vector, width, height, category, updateRefObj):
        # minimum inputs required
        if not centerline:
            self.AddRuntimeMessage(Warning, "Input parameter 'Centerline' failed to collect data")
        if not width:
            self.AddRuntimeMessage(Warning, "Input parameter 'Width' failed to collect data")
        if not height:
            self.AddRuntimeMessage(Warning, "Input parameter 'Height' failed to collect data")

        # reformat unset parameters for consistency
        if not z_vector:
            z_vector = [None]
        if not category:
            category = [None]

        beams = []
        blanks = []
        scene = Scene()

        if centerline and height and width:
            # check list lengths for consistency
            N = len(centerline)
            if len(z_vector) not in (0, 1, N):
                self.AddRuntimeMessage(
                    Error, " In 'ZVector' I need either none, one or the same number of inputs as the Crv parameter."
                )
            if len(width) not in (1, N):
                self.AddRuntimeMessage(
                    Error, " In 'W' I need either one or the same number of inputs as the Crv parameter."
                )
            if len(height) not in (1, N):
                self.AddRuntimeMessage(
                    Error, " In 'H' I need either one or the same number of inputs as the Crv parameter."
                )
            if len(category) not in (0, 1, N):
                self.AddRuntimeMessage(
                    Error, " In 'Category' I need either none, one or the same number of inputs as the Crv parameter."
                )

            # duplicate data if None or single value
            if len(z_vector) != N:
                z_vector = [z_vector[0] for _ in range(N)]
            if len(width) != N:
                width = [width[0] for _ in range(N)]
            if len(height) != N:
                height = [height[0] for _ in range(N)]
            if len(category) != N:
                category = [category[0] for _ in range(N)]

            for line, z, w, h, c in zip(centerline, z_vector, width, height, category):
                guid, geometry = self._get_guid_and_geometry(line)
                rhino_line = rs.coerceline(geometry)
                line = line_to_compas(rhino_line)

                z = vector_to_compas(z) if z else None
                beam = CTBeam.from_centerline(centerline=line, width=w, height=h, z_vector=z)
                beam.attributes["rhino_guid"] = str(guid) if guid else None
                beam.attributes["category"] = c
                print(guid)
                if updateRefObj and guid:
                    update_rhobj_attributes_name(guid, "width", str(w))
                    update_rhobj_attributes_name(guid, "height", str(h))
                    update_rhobj_attributes_name(guid, "zvector", str(list(beam.frame.zaxis)))
                    update_rhobj_attributes_name(guid, "category", c)

                beams.append(beam)
                scene.add(beam.blank)

        blanks = scene.draw()

        return beams, blanks

    def _get_guid_and_geometry(self, line):
        # internalized curves and GH geometry will not have persistent GUIDs, referenced Rhino objects will
        # type hint on the input has to be 'ghdoc' for this to work
        guid = None
        geometry = line
        rhino_obj = ActiveDoc.Objects.FindId(line)
        if rhino_obj:
            guid = line
            geometry = rhino_obj.Geometry
        return guid, geometry
# ---------- end beam ----------
beam_2 = CTBeam(Centerline=filter_2, ZVector=filter, Width=number_slider_3, Height=number_slider_3)  # -> Beam, Blank; inputs Centerline: list, ZVector: list of Vector3d, Width: list, Height: list, Category: list, updateRefObj: Boolean; same code as beam
beam_3 = CTBeam(Centerline=filter_2, ZVector=Z_2, Width=number_slider_3, Height=number_slider_3)  # -> Beam, Blank; inputs Centerline: list, ZVector: list of Vector3d, Width: list, Height: list, Category: list, updateRefObj: Boolean; same code as beam
number_slider_4 = Slider(19, range=0..100)
edges = BrepEdges(Brep=beam_2.Blank)  # -> Naked, Interior, NonManifold
edges_2 = BrepEdges(Brep=beam.Blank)  # -> Naked, Interior, NonManifold
center = Center(Geometry=beam_3.Blank)  # -> Center, Dimension

# ---- group: Ref_Side
number_slider_5 = Slider(3, range=0..15)
number_slider_6 = Slider(2, range=0..5)

# ----
width = Slider(19, range=0..200)
number_slider_7 = Slider(24, range=0..200)
cone_angle = Slider(15, range=0..100)

length = Slider(63, range=0..200)
rot3d = Rotate3D(Geometry=beam_3.Blank, Angle=degrees(subtraction), Center=center.Center, Axis=move_2.Geometry)  # -> Geometry, Transform
python = GhPythonScript(
    cross_beam=beam.Beam,
    main_beam=beam_2.Beam,
    index=number_slider_5,
    ref_side_index=number_slider_6,
    start_depth=number_slider_7,
    width=width,
    length=length,
    cone_angle=cone_angle)  # -> out, rg_cutting_plane, rg_ref_side, btlx_params, rg_geometry, rg_planes, rg_tenon, rg_vect; inputs index: Int32, ref_side_index: Int32
# ---------- python: Python ----------
from compas_rhino.conversions import surface_to_rhino
from compas_timber._fabrication import DovetailTenon
from compas_timber._fabrication import DovetailTenonParams

from compas_timber.model import TimberModel
from compas_timber.fabrication import BTLx

from compas_rhino import unload_modules
from compas.scene import SceneObject

from compas_rhino.conversions import frame_to_rhino, plane_to_rhino, vector_to_rhino, surface_to_rhino, polyline_to_rhino, brep_to_rhino, point_to_rhino, surface_to_rhino

import Rhino.Geometry as rg
unload_modules("compas_timber")

#define beam and cutting plane
beam = main_beam
plane = cross_beam.ref_sides[index]
geo = beam.compute_geometry(False)

#create dovetail_tenon
DovetailTenon.define_dovetail_tool(15.0, 30.0, 28.0)
dovetail_tenon = DovetailTenon.from_plane_and_beam(plane, beam, start_depth=start_depth, width=width, length=length, cone_angle=cone_angle, ref_side_index=ref_side_index)
cutting_plane= dovetail_tenon.frame_from_params_and_beam(beam)
tenon_volume = dovetail_tenon.dovetail_volume_from_params_and_beam(beam)
geometry = dovetail_tenon.apply(geo, beam)

print("Orientation: ", dovetail_tenon.orientation)
print("StrutInclination: ", dovetail_tenon.inclination)


#get btlx params
dovetail_tenon_params = DovetailTenonParams(dovetail_tenon).as_dict()
btlx_params = []
for key, value in dovetail_tenon_params.items():
    btlx_params.append("{0}: {1}".format(key, value))

#vizualize in rhino
rg_ref_side = frame_to_rhino(beam.ref_sides[ref_side_index])
rg_cutting_plane = frame_to_rhino(cutting_plane)
rg_geometry = brep_to_rhino(geometry)
rg_tenon = brep_to_rhino(tenon_volume)

rg_vect = vector_to_rhino(beam.centerline.direction)
# ---------- end python ----------
btlx_params = Panel(python.btlx_params)
panel = Panel(python.out)
pln_2 = Plane(python.rg_ref_side)
item = ListItem(List=panel, Index=0, Wrap=True)
deg_2 = Degrees(Radians=item)
pln_3 = Plane(python.rg_cutting_plane)
brep = Brep(python.rg_geometry)
pln_4 = Plane(python.rg_planes)
pln_5 = Plane(python.rg_cutting_plane)
brep_2 = Brep(python.rg_tenon)
deplane = DeconstructPlane(Plane=python.rg_ref_side)  # -> Origin, XAxis, YAxis, ZAxis
pl = PlaneNormal(Origin=pln_2, ZAxis=python.rg_vect)
cluster = Cluster(brep=brep)  # disabled
deplane_2 = DeconstructPlane(Plane=pln_5)  # -> Origin, XAxis, YAxis, ZAxis
Z_4 = UnitZ(Factor=1)
Z_5 = UnitZ(Factor=1)

# ----
# StepJoint
python_2 = GhPythonScript(
    cross_beam=beam.Beam,
    main_beam=beam_2.Beam,
    index=number_slider_5,
    ref_side_index=number_slider_6,
    step=number_slider_7,
    heel=width,
    tenon_height=cone_angle)  # -> out, step_joint, rg_cutting_plane, rg_planes, rg_ref_side, rg_geometry, btlx_params; inputs index: Int32, ref_side_index: Int32; disabled
# ---------- python_2: Python ----------
import compas
from compas_rhino.conversions import surface_to_rhino
from compas_timber._fabrication import StepJointNotch
from compas_timber._fabrication import StepJointNotchParams
from compas_timber._fabrication import StepJoint
from compas_timber._fabrication import StepJointParams

from compas_timber.model import TimberModel
from compas_timber.fabrication import BTLx

from compas_rhino import unload_modules
from compas.scene import SceneObject

from compas_rhino.conversions import frame_to_rhino, plane_to_rhino, surface_to_rhino, polyline_to_rhino, brep_to_rhino, mesh_to_rhino

import Rhino.Geometry as rg
unload_modules("compas_timber")

#define beam and cutting plane
beam = main_beam
geo = beam.compute_geometry(False)
plane = cross_beam.ref_sides[index]

#create step_joint
step_joint = StepJoint.from_plane_and_beam(plane, beam, step, heel, tapered, ref_side_index)
cutting_planes = step_joint.planes_from_params_and_beam(beam)
print("Orientation: ", step_joint.orientation)
print("StrutInclination: ", step_joint.strut_inclination)

#add tenon
if tenon_height > 0:
    step_joint.add_tenon(cross_beam.width/4, tenon_height)
    tenon_volume = step_joint.tenon_volume_from_params_and_beam(beam)
    tenon_volume = brep_to_rhino(tenon_volume)

#apply geometric features
geometry = step_joint.apply(geo, beam)
rg_geometry = brep_to_rhino(geometry)
rg_geometry.MergeCoplanarFaces(0.01)

#get btlx params
step_joint_params = StepJointParams(step_joint).as_dict()
btlx_params = []
for key, value in step_joint_params.items():
    btlx_params.append("{0}: {1}".format(key, value))

#vizualize in rhino
rg_ref_side = frame_to_rhino(beam.ref_sides[ref_side_index])
rg_cutting_plane = frame_to_rhino(plane)
rg_planes = (plane_to_rhino(plane) for plane in cutting_planes)
# ---------- end python_2 ----------
panel_2 = Panel(python_2.out)  # disabled
btlx_params_3 = Panel(python_2.btlx_params)  # disabled

angle_2 = Angle(VectorA=pln_2, VectorB=pl, Plane=Z_5)  # -> Angle, Reflex
deplane_3 = DeconstructPlane(Plane=pl)  # -> Origin, XAxis, YAxis, ZAxis
angle_3 = Angle(VectorA=pln_2, VectorB=Z_4, Plane=pl)  # -> Angle, Reflex
deg_3 = Degrees(Radians=angle_2.Angle)
panel_3 = Panel(deg_3)
deg_4 = Degrees(Radians=angle_3.Angle)  # -> expr("360-x", Degrees)
panel_4 = Panel(deg_4)
f_svang = SignedVectorAngle(Vector1=deplane.ZAxis, Vector2=Z_4, ZAxis=python.rg_vect)
dprod_2 = DotProduct(VectorA=deplane_3.ZAxis, VectorB=crv_2, Unitize=False)
vdis_3 = VectorDisplay(Anchor=pln_2, Vector=expr("x*100", [deplane_2.ZAxis, Z_4]))
Z_6 = UnitZ(Factor=1)
deg_5 = Degrees(Radians=f_svang)
xprod_2 = CrossProduct(VectorA=pln_2, VectorB=Z_6, Unitize=False)  # -> Vector, Length
pl_2 = PlaneNormal(Origin=Point(0, 0, 0), ZAxis=xprod_2.Vector)
angle_4 = Angle(VectorA=pln_2, VectorB=Z_6, Plane=pl_2)  # -> Angle, Reflex
deg_6 = Degrees(Radians=angle_4.Angle)
panel_5 = Panel(deg_6)

# ---- group: GEOMETRY
brep_3 = Brep(python_2.rg_geometry)  # disabled
swatch = ColourSwatch(SwatchColor=RGBA(0, 102, 255, 29))  # disabled
edges_3 = BrepEdges(Brep=brep_3)  # -> Naked, Interior, NonManifold; disabled
previewlw = CustomPreviewLineweights(Geometry=edges_3.Interior, Shader=swatch, Absolute=False)  # disabled
preview = CustomPreview(Geometry=brep_3, Material=swatch)  # disabled

# ---- group: CUTTING PLANE
pln_6 = Plane(python_2.rg_cutting_plane)  # disabled

# ---- group: REF_SIDE
pln_7 = Plane(python_2.rg_ref_side)  # disabled

# ---- group: notch_planes
pln_8 = Plane(python_2.rg_planes)  # disabled

# ----
# TStepJoint
python_3 = GhPythonScript(
    cross_beam=beam.Beam,
    main_beam=beam_2.Beam,
    step_depth=number_slider_7,
    heel_depth=width,
    tenon_mortise_height=cone_angle)  # -> out, geometry, BTLx; disabled
# ---------- python_3: Python ----------
from compas_timber.connections import TStepJoint

from compas_timber.model import TimberModel
from compas_timber.fabrication import BTLx

from compas_rhino.conversions import brep_to_rhino

from compas_rhino import unload_modules

unload_modules("compas_timber")

# Instantiate TimberModel & Add Beams
timber_model = TimberModel()
beams = [cross_beam, main_beam]
for beam in beams:
    timber_model.add_beam(beam)

# Create TStepJoint joint
step_joint_joint = TStepJoint.create(
    timber_model,
    main_beam,
    cross_beam,
    step_depth=step_depth,
    heel_depth=heel_depth,
    tapered_heel=tapered_heel,
    tenon_mortise_height=tenon_mortise_height
    )

# Generate Geometry
geometry = [brep_to_rhino(beam.compute_geometry()) for beam in timber_model.beams]

# Write BTLx
btlx = BTLx(timber_model)
BTLx = btlx.btlx_string()
# ---------- end python_3 ----------
panel_6 = Panel(python_3.out)  # disabled

panel_7 = Panel(python_3.BTLx)  # disabled

# ---- group: GEOMETRY
swatch_2 = ColourSwatch(SwatchColor=RGBA(0, 102, 255, 29))  # disabled
swatch_3 = ColourSwatch(SwatchColor=RGBA(240, 180, 137, 34))  # disabled
brep_4 = Brep(python_3.geometry)  # disabled
entwine = Entwine(Branch00=swatch_2, Branch01=swatch_3, FlattenInputs=True)  # disabled
edges_4 = BrepEdges(Brep=brep_4)  # -> Naked, Interior, NonManifold; disabled
previewlw_2 = CustomPreviewLineweights(Geometry=edges_4.Interior, Shader=graft(entwine), Absolute=False)  # disabled
preview_2 = CustomPreview(Geometry=brep_4, Material=flatten(entwine))  # disabled

# ==== cluster Cluster
brep = ClusterInput()
brep_2 = Brep(brep)
debrep = DeconstructBrep(Brep=brep_2)  # -> Faces, Edges, Vertices
midpt = CurveMiddle(Curve=debrep.Edges)
points = PointList(Points=midpt, Size=Slider(10, range=0..10))
pdecon = Deconstruct(Point=midpt)  # -> XComponent, YComponent, ZComponent
sort = SortList(Keys=pdecon.ZComponent, ValuesA=debrep.Edges)  # -> Keys, ValuesA
split = SplitList(List=sort.ValuesA, Index="4")  # -> ListA, ListB
sort_2 = SortList(Keys=split.ListA, ValuesA=split.ListA)  # -> Keys, ValuesA
panel = Panel("""0
-1""")
cull_i = CullIndex(List=sort_2.ValuesA, Indices=panel, Wrap=True)
index = ItemIndex(List=debrep.Edges, Item=cull_i)
filedge = FilletEdge(Shape=brep_2, Blend=0, Metric=0, Edges=index, Radii=Slider(7, range=0..10))
