# Grasshopper definition test_step_joint.ghx (Grasshopper 1.0.7)
# plug-ins: Human

X = UnitX(Factor=Slider(0, range=0..2000))
Z = UnitZ(Factor=Slider(0, range=0..2000))

# ---- group: MainBeam
flipcurve = BooleanToggle(False)
crv = Curve(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)

# ---- group: CrossBeam
crv_2 = Curve(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)

# ----
end = EndPoints(Curve=crv)  # -> Start, End
addition = Addition(A=X, B=Z)
move = Move(Geometry=end.End, Motion=expr("-x", addition))  # -> Geometry, Transform
ln = Line(StartPoint=end.Start, EndPoint=move.Geometry)
number_slider = Slider(100, range=0..100)
flip = FlipCurve(Curve=ln)  # -> Curve, Flag
filter = StreamFilter(Gate=flipcurve, Stream0=ln, Stream1=flip.Curve)
beam = CTBeam(Centerline=filter, Width=Slider(80, range=0..100), Height=Slider(100, range=0..100))  # -> Beam, Blank; inputs Centerline: list, ZVector: list of Vector3d, Width: list, Height: list, Category: list, updateRefObj: Boolean
#   port Centerline: Referenced curve or line, Guid of curve or line in the active Rhino document.
#   port ZVector: Vector defining the orientation of the cross-section (corresponds to the height dimension). If None, a default will be taken.
#   port Width: Width of the cross-section (usually the smaller dimension).
#   port Height: Height of the cross-section (usually the larger dimension).
#   port Category: Category of a beam.
#   port updateRefObj: (optional) If True, the attributes in the referenced object will be updated/overwritten with the new values given here.
#   port Beam: Beam object(s).
#   port Blank: Shape of the beam's blank.
# ---------- beam: Python ----------
"""Creates a Beam from a LineCurve."""

import rhinoscriptsyntax as rs
from compas.scene import Scene
from compas_rhino.conversions import line_to_compas
from compas_rhino.conversions import vector_to_compas
from ghpythonlib.componentbase import executingcomponent as component
from Grasshopper.Kernel.GH_RuntimeMessageLevel import Error
from Grasshopper.Kernel.GH_RuntimeMessageLevel import Warning
from Rhino.RhinoDoc import ActiveDoc

from compas_timber.elements import Beam as CTBeam
from compas_timber.ghpython.rhino_object_name_attributes import update_rhobj_attributes_name


class Beam_fromCurve(component):
    def RunScript(self, centerline, z_vector, width, height, category, updateRefObj):
        # minimum inputs required
        if not centerline:
            self.AddRuntimeMessage(Warning, "Input parameter 'Centerline' failed to collect data")
        if not width:
            self.AddRuntimeMessage(Warning, "Input parameter 'Width' failed to collect data")
        if not height:
            self.AddRuntimeMessage(Warning, "Input parameter 'Height' failed to collect data")

        # reformat unset parameters for consistency
        if not z_vector:
            z_vector = [None]
        if not category:
            category = [None]

        beams = []
        blanks = []
        scene = Scene()

        if centerline and height and width:
            # check list lengths for consistency
            N = len(centerline)
            if len(z_vector) not in (0, 1, N):
                self.AddRuntimeMessage(
                    Error, " In 'ZVector' I need either none, one or the same number of inputs as the Crv parameter."
                )
            if len(width) not in (1, N):
                self.AddRuntimeMessage(
                    Error, " In 'W' I need either one or the same number of inputs as the Crv parameter."
                )
            if len(height) not in (1, N):
                self.AddRuntimeMessage(
                    Error, " In 'H' I need either one or the same number of inputs as the Crv parameter."
                )
            if len(category) not in (0, 1, N):
                self.AddRuntimeMessage(
                    Error, " In 'Category' I need either none, one or the same number of inputs as the Crv parameter."
                )

            # duplicate data if None or single value
            if len(z_vector) != N:
                z_vector = [z_vector[0] for _ in range(N)]
            if len(width) != N:
                width = [width[0] for _ in range(N)]
            if len(height) != N:
                height = [height[0] for _ in range(N)]
            if len(category) != N:
                category = [category[0] for _ in range(N)]

            for line, z, w, h, c in zip(centerline, z_vector, width, height, category):
                guid, geometry = self._get_guid_and_geometry(line)
                rhino_line = rs.coerceline(geometry)
                line = line_to_compas(rhino_line)

                z = vector_to_compas(z) if z else None
                beam = CTBeam.from_centerline(centerline=line, width=w, height=h, z_vector=z)
                beam.attributes["rhino_guid"] = str(guid) if guid else None
                beam.attributes["category"] = c
                print(guid)
                if updateRefObj and guid:
                    update_rhobj_attributes_name(guid, "width", str(w))
                    update_rhobj_attributes_name(guid, "height", str(h))
                    update_rhobj_attributes_name(guid, "zvector", str(list(beam.frame.zaxis)))
                    update_rhobj_attributes_name(guid, "category", c)

                beams.append(beam)
                scene.add(beam.blank)

        blanks = scene.draw()

        return beams, blanks

    def _get_guid_and_geometry(self, line):
        # internalized curves and GH geometry will not have persistent GUIDs, referenced Rhino objects will
        # type hint on the input has to be 'ghdoc' for this to work
        guid = None
        geometry = line
        rhino_obj = ActiveDoc.Objects.FindId(line)
        if rhino_obj:
            guid = line
            geometry = rhino_obj.Geometry
        return guid, geometry
# ---------- end beam ----------
beam_2 = CTBeam(Centerline=crv_2, Width=number_slider, Height=number_slider)  # -> Beam, Blank; inputs Centerline: list, ZVector: list of Vector3d, Width: list, Height: list, Category: list, updateRefObj: Boolean; same code as beam

# ---- group: Ref_Side
number_slider_2 = Slider(0, range=0..5)
number_slider_3 = Slider(2, range=0..15)

# ---- group: Tenon/Mortise
tenon_mortise_height = Slider(30, range=0..100)

# ---- group: StepShape
number_slider_4 = Slider(30, range=0..200)
number_slider_5 = Slider(15, range=0..200)
tapered_heel = BooleanToggle(True)

# ----
# StepJoint
python = GhPythonScript(
    cross_beam=beam_2.Beam,
    main_beam=beam.Beam,
    index=number_slider_3,
    ref_side_index=number_slider_2,
    step=number_slider_4,
    heel=number_slider_5,
    tapered=tapered_heel,
    mortise_height=tenon_mortise_height)  # -> out, surface, rg_cutting_plane, rg_planes, rg_ref_side, rg_mortise_polylines, btlx_params; inputs index: Int32, ref_side_index: Int32
# ---------- python: Python ----------
from compas_rhino.conversions import surface_to_rhino
from compas_timber._fabrication import StepJointNotch
from compas_timber._fabrication import StepJointNotchParams
from compas_timber._fabrication import StepJoint

from compas_timber.model import TimberModel
from compas_timber.fabrication import BTLx

from compas_rhino import unload_modules
from compas.scene import SceneObject

from compas_rhino.conversions import frame_to_rhino, plane_to_rhino, surface_to_rhino, polyline_to_rhino

import Rhino.Geometry as rg
unload_modules("compas_timber")

#define beam and cutting plane
beam = main_beam
plane = cross_beam.ref_sides[index]

#create step_joint
step_joint = StepJoint.from_plane_and_beam(plane, beam, step, heel, tapered, ref_side_index)
cutting_planes = step_joint.planes_from_params_and_beam(beam)
#
###create step_joint_notch
##step_joint_notch = StepJointNotch.from_surface_and_beam(plane, beam, notch_limited=False, step_depth=step, heel_depth=heel, strut_height=100.0, tapered_heel=tapered, ref_side_index=ref_side_index)
##cutting_planes = step_joint_notch.planes_from_params_and_beam(beam)
##
##print("Orientation: ", step_joint_notch.orientation)
##print("StartX: ", step_joint_notch.start_x)
##print("StrutInclination: ", step_joint_notch.strut_inclination)
##
##
###add mortise
##if mortise_height > 0:
##    step_joint_notch.add_mortise(beam.width/4, mortise_height, beam)
##    mortise_polylines = step_joint_notch.mortise_volume_from_params_and_beam(beam)
##
####apply geometric features
###step_joint_notch.apply(brep, beam)
##
###get btlx params
##step_joint_notch_params = StepJointNotchParams(step_joint_notch).as_dict()
##btlx_params = []
##for key, value in step_joint_notch_params.items():
##    btlx_params.append("{0}: {1}".format(key, value))
##
##
##vizualize in rhino
rg_ref_side = frame_to_rhino(beam.ref_sides[ref_side_index])
rg_cutting_plane = frame_to_rhino(plane)
rg_planes = (plane_to_rhino(plane) for plane in cutting_planes)
##
##rg_mortise_polylines = [polyline_to_rhino(polyline) for polyline in mortise_polylines]
# ---------- end python ----------
panel = Panel(python.out)
cluster = Cluster_2(brep=beam.Blank, pln=python.rg_planes, C=python.rg_mortise_polylines, bool=Toggle(False))
btlx_params = Panel(python.btlx_params)
edges = BrepEdges(Brep=cluster)  # -> Naked, Interior, NonManifold
previewlw = CustomPreviewLineweights(
    Geometry=edges.Interior,
    Shader={diffuse=RGB(255, 105, 180), emission=RGB(76, 32, 54), shine=0.5, specular=RGB(255, 255, 255), transparency=0},
    Absolute=False)
preview = CustomPreview(
    Geometry=cluster,
    Material={diffuse=RGB(221, 160, 221), emission=RGB(66, 48, 66), shine=0.5, specular=RGB(255, 255, 255), transparency=0})

# ----
# StepJointNotch
python_2 = GhPythonScript(
    cross_beam=beam_2.Beam,
    main_beam=beam.Beam,
    index=number_slider_2,
    ref_side_index=number_slider_3,
    step=number_slider_4,
    heel=number_slider_5,
    tapered=tapered_heel,
    mortise_height=tenon_mortise_height)  # -> out, surface, rg_cutting_plane, rg_planes, rg_ref_side, rg_mortise_polylines, btlx_params; inputs index: Int32, ref_side_index: Int32
# ---------- python_2: Python ----------
from compas_rhino.conversions import surface_to_rhino
from compas_timber._fabrication import StepJointNotch
from compas_timber._fabrication import StepJointNotchParams

from compas_timber.model import TimberModel
from compas_timber.fabrication import BTLx

from compas_rhino import unload_modules
from compas.scene import SceneObject

from compas_rhino.conversions import frame_to_rhino, plane_to_rhino, surface_to_rhino, polyline_to_rhino

import Rhino.Geometry as rg
unload_modules("compas_timber")

#define beam and cutting plane
beam = cross_beam
plane = main_beam.ref_sides[index]

#create step_joint_notch
step_joint_notch = StepJointNotch.from_surface_and_beam(plane, beam, notch_limited=False, step_depth=step, heel_depth=heel, strut_height=100.0, tapered_heel=tapered, ref_side_index=ref_side_index)
cutting_planes = step_joint_notch.planes_from_params_and_beam(beam)

#print("Orientation: ", step_joint_notch.orientation)
#print("StartX: ", step_joint_notch.start_x)
#print("StrutInclination: ", step_joint_notch.strut_inclination)


#add mortise
if mortise_height > 0:
    step_joint_notch.add_mortise(beam.width/4, mortise_height, beam)
    mortise_polylines = step_joint_notch.mortise_volume_from_params_and_beam(beam)
    rg_mortise_polylines = [polyline_to_rhino(polyline) for polyline in mortise_polylines]

##apply geometric features
#step_joint_notch.apply(brep, beam)

#get btlx params
step_joint_notch_params = StepJointNotchParams(step_joint_notch).as_dict()
btlx_params = []
for key, value in step_joint_notch_params.items():
    btlx_params.append("{0}: {1}".format(key, value))


#vizualize in rhino
rg_ref_side = frame_to_rhino(beam.ref_sides[ref_side_index])
rg_cutting_plane = frame_to_rhino(plane)
rg_planes = (plane_to_rhino(plane) for plane in cutting_planes)
# ---------- end python_2 ----------
panel_2 = Panel(python_2.out)
cluster_2 = Cluster(B=beam_2.Blank, pln=python_2.rg_planes, pln_2=python_2.rg_ref_side, C=python_2.rg_mortise_polylines)
btlx_params_2 = Panel(python_2.btlx_params)
swatch = ColourSwatch(SwatchColor=RGBA(168, 168, 168, 34))
edges_2 = BrepEdges(Brep=cluster_2)  # -> Naked, Interior, NonManifold
preview_2 = CustomPreview(Geometry=cluster_2, Material=swatch)
previewlw_2 = CustomPreviewLineweights(Geometry=edges_2.Interior, Shader=swatch, Absolute=False)

# ---- group: CUTTING PLANE
pln = Plane(python.rg_cutting_plane)

# ---- group: REF_SIDE
pln_2 = Plane(python.rg_ref_side)

# ---- group: CUTTING PLANE
pln_3 = Plane(python_2.rg_cutting_plane)

# ---- group: notch_planes
pln_4 = Plane(python.rg_planes)

# ---- group: REF_SIDE
pln_5 = Plane(python_2.rg_ref_side)

# ---- group: notch_planes
pln_6 = Plane(python_2.rg_planes)

# ==== cluster Cluster
pln = ClusterInput()
pln_2 = ClusterInput()
pln_3 = Plane(pln)
pln_4 = Plane(pln_2)
dispatch = Dispatch(List=pln_3, DispatchPattern=[True, False])  # -> ListA, ListB
deplane = DeconstructPlane(Plane=dispatch.ListB)  # -> Origin, XAxis, YAxis, ZAxis
pl_origin = PlaneOrigin(Base=pln_4, Origin=deplane.Origin)
number_slider = Slider(200, range=0..200)
number_slider_2 = Slider(200, range=0..200)
neg = Negative(Value=number_slider)
dom = ConstructDomain(DomainStart=neg, DomainEnd=number_slider)
C = ClusterInput()
dom_2 = ConstructDomain(DomainStart=expr("-x", number_slider_2), DomainEnd=number_slider_2)
loft = Loft(Curves=C, Options={Adjust=False, Closed=False, LoftEnds=0, LoftSimp=0, LoftType=0, Rebuild=10, Refit=0.01})
planesrf = PlaneSurface(Plane=dispatch.ListA, XSize=dom, YSize=dom)
planesrf_2 = PlaneSurface(Plane=dispatch.ListB, XSize=dom, YSize=dom)
planesrf_3 = PlaneSurface(Plane=pl_origin, XSize=dom, YSize=dom)
B = ClusterInput()
planesrf_4 = PlaneSurface(Plane=pln_3, XSize=dom_2, YSize=dom_2)
cap = CapHoles(Brep=loft)
bbx = BrepBrep(BrepA=planesrf, BrepB=planesrf_2)  # -> Curves, Points
bbx_2 = BrepBrep(BrepA=planesrf, BrepB=planesrf_3)  # -> Curves, Points
bbx_3 = BrepBrep(BrepA=planesrf_2, BrepB=planesrf_3)  # -> Curves, Points
splitmul = SplitBrepMultiple(Brep=cap, Cutters=planesrf_4)
debrep = DeconstructBrep(Brep=splitmul)  # -> Faces, Edges, Vertices
tstat = TreeStatistics(Tree=debrep.Faces)  # -> Paths, Length, Count
larger = LargerThan(FirstNumber=tstat.Length, SecondNumber=Slider(1, range=0..1))  # -> LargerThan, OrEqualTo
flip = FlipCurve(Curve=bbx_3.Curves, Guide=bbx.Curves)  # -> Curve, Flag
flip_2 = FlipCurve(Curve=bbx_2.Curves, Guide=bbx.Curves)  # -> Curve, Flag
rulesrf = RuledSurface(CurveA=bbx.Curves, CurveB=[flip.Curve, flip_2.Curve])
sort = SortList(Keys=splitmul, ValuesA=splitmul)  # -> Keys, ValuesA
dispatch_2 = Dispatch(List=splitmul, DispatchPattern=larger.LargerThan)  # -> ListA, ListB
item = ListItem(List=reverse(sort.ValuesA), Index=0, Wrap=True)
join = BrepJoin(Breps=flatten(rulesrf))  # -> Breps, Closed
item_2 = ListItem(List=dispatch_2.ListA, Index=0, Wrap=True)
bbx_4 = BrepBrep(BrepA=planesrf_4, BrepB=item_2)  # -> Curves, Points
split = SplitBrep(Brep=B, Cutter=join.Breps)
connect = ConnectCurves(Curves=bbx_4.Curves, Continuity=0, Close=True, Bulge=1)
sort_2 = SortList(Keys=split, ValuesA=split)  # -> Keys, ValuesA
boundary = BoundarySurfaces(Edges=connect)
item_3 = ListItem(List=reverse(sort_2.ValuesA), Index=0, Wrap=True)
join_2 = BrepJoin(Breps=flatten([item_2, boundary]))  # -> Breps, Closed
split_2 = SplitBrep(Brep=join.Breps, Cutter=item_3)
item_4 = ListItem(List=split_2, Index=0, Wrap=True)
join_3 = BrepJoin(Breps=flatten([item_3, item_4]))  # -> Breps, Closed
brep = Brep(join_3.Breps)
brep_2 = Brep(join_2.Breps)
null = NullItem(Item=brep_2)  # -> NullFlags, InvalidFlags, Description
sdiff = SolidDifference(BrepsA=brep, BrepsB=brep_2)
filter = StreamFilter(Gate=null.NullFlags, Stream0=sdiff, Stream1=brep)
s_0 = ClusterOutput(filter)

# ==== cluster Cluster_2
number_slider = Slider(400, range=0..400)
pln = ClusterInput()
brep = ClusterInput()
pln_2 = Plane(pln)
brep_2 = Brep(brep)
neg = Negative(Value=number_slider)
lng = ListLength(List=pln_2)  # -> expr("x-1", Length)
dom = ConstructDomain(DomainStart=neg, DomainEnd=number_slider)
bool = ClusterInput()
planesrf = PlaneSurface(Plane=pln_2, XSize=dom, YSize=dom)
number_slider_2 = Slider(200, range=0..200)
split = SplitList(List=planesrf, Index="2")  # -> ListA, ListB
C = ClusterInput()
dispatch = Dispatch(List=split.ListA, DispatchPattern=[True, False])  # -> ListA, ListB
dom_2 = ConstructDomain(DomainStart=expr("-x", number_slider_2), DomainEnd=number_slider_2)
loft = Loft(Curves=C, Options={Adjust=False, Closed=False, LoftEnds=0, LoftSimp=0, LoftType=0, Rebuild=10, Refit=0.01})
bbx = BrepBrep(BrepA=dispatch.ListA, BrepB=dispatch.ListB)  # -> Curves, Points
planesrf_2 = PlaneSurface(Plane=pln_2, XSize=dom_2, YSize=dom_2)
cap = CapHoles(Brep=loft)
srfsplit = SurfaceSplit(Surface=split.ListA, Curves=bbx.Curves)
tstat = TreeStatistics(Tree=srfsplit)  # -> Paths, Length, Count
dispatch_2 = Dispatch(List=tstat.Paths, DispatchPattern=[True, False])  # -> ListA, ListB
splitmul = SplitBrepMultiple(Brep=cap, Cutters=planesrf_2)
split_2 = SplitTree(Data=srfsplit, Masks=flatten(dispatch_2.ListA))  # -> Positive, Negative
sort = SortList(Keys=srfsplit, ValuesA=srfsplit)  # -> Keys, ValuesA
sort_2 = SortList(Keys=splitmul, ValuesA=splitmul)  # -> Keys, ValuesA
rev = ReverseList(List=split_2.Positive)
item = ListItem(List=reverse(sort.ValuesA), Index=0, Wrap=True)
item_2 = ListItem(List=reverse(sort_2.ValuesA), Index=0, Wrap=True)
entwine = Entwine(Branch00=rev, Branch01=split_2.Negative, FlattenInputs=True)
bool_2 = Boolean(bool)
bbx_2 = BrepBrep(BrepA=planesrf_2, BrepB=item_2)  # -> Curves, Points
item_3 = ListItem(List=entwine, Index=0, Wrap=True)  # -> Item, Item1
connect = ConnectCurves(Curves=bbx_2.Curves, Continuity=0, Close=True, Bulge=1)
filter = StreamFilter(Gate=bool_2, Stream0=item_3.Item, Stream1=item_3.Item1)
join = BrepJoin(Breps=flatten(filter))  # -> Breps, Closed
merge = Merge(Data1=join.Breps, Data2=split.ListB)  # -> flatten(Result)
boundary = BoundarySurfaces(Edges=connect)
splitmul_2 = SplitBrepMultiple(Brep=brep_2, Cutters=flatten(merge))
join_2 = BrepJoin(Breps=flatten([item_2, boundary]))  # -> Breps, Closed
sort_3 = SortList(Keys=splitmul_2, ValuesA=splitmul_2)  # -> Keys, ValuesA
brep_3 = Brep(join_2.Breps)
item_4 = ListItem(List=reverse(sort_3.ValuesA), Index=0, Wrap=True)
bbx_3 = BrepBrep(BrepA=item_4, BrepB=simplify(filter))  # -> Curves, Points
connect_2 = ConnectCurves(Curves=bbx_3.Curves, Continuity=0, Close=True, Bulge=1)
boundary_2 = BoundarySurfaces(Edges=connect_2)
join_3 = BrepJoin(Breps=flatten([boundary_2, item_4]))  # -> Breps, Closed
cap_2 = CapHoles(Brep=join_3.Breps)
merge_2 = Merge(Data1=cap_2, Data2=brep_3)
sunion = SolidUnion(Breps=merge_2)
R = ClusterOutput(sunion)
